# Grasshopper definition seat.gh (Grasshopper 1.0.5)

# ---- group: Boundary Curve
crv = Curve(<curve referenced from the Rhino model>)

# ----
bbox = BoundingBox(Content=crv, Plane=PlaneXY(0, 0, 0), UnionBox=True)  # -> Box, Box_2
debrep = DeconstructBrep(Brep=bbox.Box)  # -> Faces, Edges, Vertices
join = JoinCurves(Curves=debrep.Edges, Preserve=False)
number_slider = Slider(10, range=0..10)
rad = Radians(Degrees=Slider(0, range=0..360))
pi = Pi(Factor=Slider(0, range=0..2))
boundary = BoundarySurfaces(Edges=join)
disc = Discontinuity(Curve=crv, Level=1)  # -> Points, Parameters
substrate = Substrate(Border=join, Count=Slider(8, range=0..20), Angles=pi, Deviation=rad, Seed=number_slider)
srf_cp = SurfaceClosestPoint(Point=disc.Points, Surface=boundary)  # -> Point, UVPoint, Distance
iso = IsoCurve(Surface=boundary, UVPoint=srf_cp.UVPoint)  # -> UIsocurve, VIsocurve
cset = CreateSet(List=[50, 100, 150, 200])  # -> Set, Map
number_slider_2 = Slider(4, range=0..15)
boundary_2 = BoundarySurfaces(Edges=crv)
crv_2 = Curve(flatten([iso.VIsocurve, substrate]))
dup = DuplicateData(Data=cset.Set, Number=21, Order=True)
galapagos = Galapagos(fitness=mass_addition, gene=[number_slider, number_slider_2])
jitter = Jitter(List=dup, Jitter=1, Seed=number_slider_2)  # -> Values, Indices
srfsplit = SurfaceSplit(Surface=boundary_2, Curves=crv_2)
Z = UnitZ(Factor=jitter.Values)
wires = BrepWireframe(Brep=srfsplit, Density=-1)
extr = Extrude(Base=srfsplit, Direction=Z)
volume = Volume(Geometry=extr)  # -> Volume, Centroid
mass_addition = MassAddition(Input=volume.Volume)  # -> Result, PartialResults
panel = Panel(mass_addition.Result)
