# Grasshopper definition Waffling mesh.gh (Grasshopper 1.0.5)
# plug-ins: Parakeet

# ----
# Parameters
kerf_of_mdf = Slider(1, range=-10..10)
kerf_of_acrylic = Slider(1, range=-10..10)
rotate_grid = Slider(0, range=0..360)
mdf_divisions = Slider(20, range=0..20)
height_of_mdf = Slider(30, range=0..50)
mdf_thickness = Slider(2, range=0..20)
acrylic_thickness = Slider(2.58, range=0..20)
height_of_acrylic = Slider(30, range=0..50)
acrylic_divisions = Slider(20, range=0..20)

mesh = Mesh(<mesh referenced from the Rhino model>)
bounding_box = BoundingBox(Content=mesh, Plane=PlaneXY(0, 0, 0))  # -> Box, Box_2

volume = Volume(Geometry=bounding_box.Box)  # -> Volume, Centroid
unit_z = UnitZ(Factor=10)
move = Move(Geometry=volume.Centroid, Motion=unit_z)  # -> Geometry, Transform
line = Line(StartPoint=volume.Centroid, EndPoint=move.Geometry)

rotate_axis = RotateAxis(Geometry=bounding_box.Box, Angle=degrees(rotate_grid), Axis=line)  # -> Geometry, Transform
box_corners = BoxCorners(Box=rotate_axis.Geometry)  # -> CornerA, CornerB, CornerC, CornerD, CornerE, CornerF, CornerG, CornerH
distance = Distance(PointA=box_corners.CornerA, PointB=box_corners.CornerE)
line_2 = Line(StartPoint=box_corners.CornerA, EndPoint=box_corners.CornerB)
line_3 = Line(StartPoint=box_corners.CornerD, EndPoint=box_corners.CornerA)
line_4 = Line(StartPoint=box_corners.CornerC, EndPoint=box_corners.CornerD)
line_5 = Line(StartPoint=box_corners.CornerB, EndPoint=box_corners.CornerC)
divide_curve = DivideCurve(Curve=line_5, Count=acrylic_divisions, Kinks=False)  # -> Points, Tangents, Parameters
divide_curve_2 = DivideCurve(Curve=line_4, Count=mdf_divisions, Kinks=False)  # -> reverse(Points), Tangents, Parameters
divide_curve_3 = DivideCurve(Curve=line_2, Count=mdf_divisions, Kinks=False)  # -> Points, Tangents, Parameters
divide_curve_4 = DivideCurve(Curve=line_3, Count=acrylic_divisions, Kinks=False)  # -> reverse(Points), Tangents, Parameters
line_6 = Line(StartPoint=divide_curve.Points, EndPoint=divide_curve_4.Points)
line_7 = Line(StartPoint=divide_curve_3.Points, EndPoint=divide_curve_2.Points)
list_length = ListLength(List=line_6)
list_length_2 = ListLength(List=line_7)
series = Series(Start=0, Step=1, Count=list_length)
series_2 = Series(Start=0, Step=1, Count=list_length_2)
list_item = ListItem(List=line_7, Index=series_2, Wrap=True)
list_item_2 = ListItem(List=line_6, Index=series, Wrap=True)
unit_z_2 = UnitZ(Factor=distance)
extrude = Extrude(Base=list_item, Direction=unit_z_2)
extrude_2 = Extrude(Base=list_item_2, Direction=unit_z_2)
mesh_plane = MeshPlane(Mesh=mesh, Plane=extrude_2)  # -> simplify(Curves)
area = Area(Geometry=extrude_2)  # -> Area, Centroid
mesh_plane_2 = MeshPlane(Mesh=mesh, Plane=extrude)  # -> simplify(Curves)
area_2 = Area(Geometry=extrude)  # -> Area, Centroid
join_curves = JoinCurves(Curves=mesh_plane_2, Preserve=True)  # -> simplify(Curves)
xz_plane = XZPlane(Origin=area.Centroid)
join_curves_2 = JoinCurves(Curves=mesh_plane, Preserve=True)  # -> simplify(Curves)
yz_plane = YZPlane(Origin=area_2.Centroid)
unit_z_3 = UnitZ(Factor=height_of_acrylic)
unit_z_4 = UnitZ(Factor=height_of_mdf)
unit_x = UnitX(Factor=mdf_thickness)
extrude_3 = Extrude(Base=join_curves, Direction=unit_z_4)
extrude_4 = Extrude(Base=join_curves_2, Direction=unit_z_3)
unit_y = UnitY(Factor=acrylic_thickness)
offset_brep = OffsetBrep(Brep=extrude_3, Distance=expr("x/2", mdf_thickness), Solid=True, BothSides=True, RoundCorners=False, MergeFaces=False)  # -> simplify(Brep)
offset_brep_2 = OffsetBrep(
    Brep=extrude_4,
    Distance=expr("x/2", acrylic_thickness),
    Solid=True,
    BothSides=True,
    RoundCorners=False,
    MergeFaces=False)  # -> simplify(flatten(Brep))
extrude_5 = Extrude(Base=extrude_3, Direction=unit_x)
extrude_6 = Extrude(Base=extrude_4, Direction=unit_y)
curve_curve = CurveCurve(CurveA=mesh_plane_2, CurveB=flatten(mesh_plane))  # -> Points, ParamsA, ParamsB
unit_z_5 = UnitZ(Factor=height_of_mdf)
division = Division(A=mdf_thickness, B=2)
division_2 = Division(A=acrylic_thickness, B=2)
move_2 = Move(Geometry=curve_curve.Points, Motion=unit_z_5)  # -> Geometry, Transform
addition = Addition(A=division, B=kerf_of_mdf)
addition_2 = Addition(A=division_2, B=kerf_of_acrylic)
center_box = CenterBox(Base=curve_curve.Points, X=addition, Y=expr("(x/2)+1", acrylic_thickness), Z=expr("x/2", height_of_acrylic))  # -> simplify(flatten(Box))
center_box_2 = CenterBox(Base=move_2.Geometry, X=expr("(x/2)+1", mdf_thickness), Y=addition_2, Z=expr("x/2", height_of_mdf))  # -> simplify(flatten(Box))

# ----
# Final Acrylic  Units
trim_solid = TrimSolid(Shape=offset_brep_2, Cutters=center_box)
custom_preview = CustomPreview(
    Geometry=trim_solid,
    Material={diffuse=RGB(0, 255, 127), emission=RGB(66, 48, 66), shine=0.5, specular=RGB(255, 255, 255), transparency=0})

# ----
# Final MDF Units
trim_solid_2 = TrimSolid(Shape=offset_brep, Cutters=center_box_2)
custom_preview_2 = CustomPreview(
    Geometry=trim_solid_2,
    Material={diffuse=RGB(221, 160, 221), emission=RGB(66, 48, 66), shine=0.5, specular=RGB(255, 255, 255), transparency=0})

unit_x_2 = UnitX(Factor=expr("x/2", mdf_thickness))
geometry = Geometry(graft(extrude))
geometry_2 = Geometry(graft(extrude_2))
unit_y_2 = UnitY(Factor=expr("x/2", acrylic_thickness))
move_3 = Move(Geometry=geometry, Motion=unit_x_2)  # -> Geometry, Transform
geometry_3 = Geometry(flatten(trim_solid_2))
geometry_4 = Geometry(flatten(trim_solid))
move_4 = Move(Geometry=geometry_2, Motion=unit_y_2)  # -> Geometry, Transform
brep_plane = BrepPlane(Brep=geometry_4, Plane=move_4.Geometry)  # -> flatten(Curves), Points
brep_plane_2 = BrepPlane(Brep=geometry_3, Plane=move_3.Geometry)  # -> flatten(Curves), Points
lng = ListLength(List=brep_plane_2.Curves)
lng_2 = ListLength(List=brep_plane.Curves)
ex = Slider(1, range=0..50)
sx = Slider(1000, range=0..1000)
sy = Slider(242.82, range=0..1000)
ex_2 = Slider(1, range=0..50)
sx_2 = Slider(1000, range=0..1000)
sy_2 = Slider(242.82, range=0..1000)
recgrid = Rectangular(Plane=PlaneXY(1839, 953, 0), SizeX=sx_2, SizeY=sy_2, ExtentX=ex_2, ExtentY=lng_2)  # -> Cells, Points
recgrid_2 = Rectangular(Plane=PlaneXY(52.03830817, 195.4514585, 0), SizeX=sx, SizeY=sy, ExtentX=ex, ExtentY=lng)  # -> Cells, Points
polygon_center = PolygonCenter(Polyline=recgrid_2.Cells)  # -> CenterV, CenterE, CenterA
polygon_center_2 = PolygonCenter(Polyline=recgrid.Cells)  # -> CenterV, CenterE, CenterA
xy = XYPlane(Origin=polygon_center.CenterV)
xy_2 = XYPlane(Origin=polygon_center_2.CenterV)
explode = Explode(Curve=recgrid_2.Cells, Recursive=True)  # -> Segments, Vertices
series_3 = Series(Start=0, Step=1, Count=lng)
explode_2 = Explode(Curve=recgrid.Cells, Recursive=True)  # -> Segments, Vertices
series_4 = Series(Start=0, Step=1, Count=lng_2)
list_item_3 = ListItem(List=explode.Vertices, Index=0, Wrap=True)  # -> flatten(Item)
list_item_4 = ListItem(List=explode_2.Vertices, Index=0, Wrap=True)  # -> flatten(Item)
concat = Concatenate(A="MDF", B=series_3)
concat_2 = Concatenate(A="Acrylic", B=series_4)

# ----
# Ready for Fabrication
# (MDF)
orient = Orient(Geometry=brep_plane_2.Curves, Source=yz_plane, Target=xy)  # -> Geometry, Transform
text_tag_3d = TextTag3D(Location=list_item_3, Text=concat, Size=30, Colour=RGB(0, 0, 0), Justification=7)

# ----
# Ready for Fabrication
# (Acrylic)
orient_2 = Orient(Geometry=brep_plane.Curves, Source=xz_plane, Target=xy_2)  # -> Geometry, Transform
text_tag_3d_2 = TextTag3D(Location=list_item_4, Text=concat_2, Size=30, Colour=RGB(0, 0, 0), Justification=7)
