# Grasshopper definition waffling.gh (Grasshopper 1.0.5)
# plug-ins: Parakeet

batwing = Batwing(T0=0.5, T1=0.75, T2=0.5, T3=0.5, D=1)  # -> out, A; inputs G0: GeometryBase, G1: GeometryBase, I: list, T0: list, T1: list, T2: list, T3: list, clr: list of Color
# ---------- batwing: VB ----------
    Component.Params.Input(0).Name = "Mesh or Curve"
    Component.Params.Input(0).Description = "Open or closed mesh or curve"
    Component.Params.Input(1).Name = "Mesh or Curve"
    Component.Params.Input(1).Description = "Optional open or closed mesh or curve whose type should correspond to G0."
    Component.Params.Input(2).Name = "Index [Face]"
    Component.Params.Input(2).Description = "An optional integer or list of integers which specify the faces to be modified if the input is a mesh. If no value is supplied then all faces will be modified"
    Component.Params.Input(3).Name = "Along Edge [Vertex]"
    Component.Params.Input(3).Description = "Evaluates a new vertex along the input geometry's edge"
    Component.Params.Input(4).Name = "Vert to Face [Vertex]"
    Component.Params.Input(4).Description = "Evaluates a new vertex between the input geometry's vertex to the face center"
    Component.Params.Input(5).Name = "Vert to Vol [Vertex]"
    Component.Params.Input(5).Description = "Evaluates a new vertex between the input geometry's vertex to the volumetric center"
    Component.Params.Input(6).Name = "Face to Vol [Vertex]"
    Component.Params.Input(6).Description = "Evaluates a new vertex between the input geometry's face center to the volumetric center"
    Component.Params.Input(7).Name = "Distance"
    Component.Params.Input(7).Description = "An optional number to add depth if no input is provided for G1"
    Component.Params.Input(8).Name = "Color [Vertex]"
    Component.Params.Input(8).Description = "(If applied to a mesh a list of colors corresponding to each mesh face, if applied to a curve, a list of colors corresponding to each control point plus an additonal color value for the new averaged center"

    Component.Params.Output(1).Name = "Mesh"
    Component.Params.Output(1).Description = "If successful, a valid mesh"

    If G0 IsNot Nothing Then

      Dim bG,bM, bP,bmC,biC As Boolean

      bM = G0.ObjectType = ObjectType.Mesh
      bP = G0.ObjectType = ObjectType.Curve

      bG = (bM Or bP)
      If G1 IsNot Nothing Then
        If bM And G1.ObjectType <> ObjectType.Mesh Then bG = False
        If bP And G1.ObjectType <> ObjectType.Curve Then bG = False
      End If

      If bG Then
        Dim msh,msha,mshe As New mesh
        Dim crv,crva As curve
        Dim av(2) As point3d
        Dim ac(2),ax(1) As color
        Dim h,j,jj,k,u,v,ua,ub,va,vb,w As Integer
        Dim cv,cf,ce,dcv As Integer
        Dim x(),y() As Integer
        Dim bnk() As Boolean = Nothing

        Dim mv,fv,ep,tv,ecv,np,tve As New list(Of Point3d)
        Dim mev,mvv,met As New dictionary(Of String, Integer)
        Dim mf As Rhino.Geometry.Collections.MeshFaceList = Nothing
        Dim mtv As Rhino.Geometry.Collections.MeshTopologyVertexList = Nothing
        Dim mte As Rhino.Geometry.Collections.MeshTopologyEdgeList = Nothing
        Dim ev As New list(Of vector3d)
        Dim ed As New list(Of Double)
        Dim en As New list(Of Boolean)
        Dim dir,dirv As New list(Of Integer)
        Dim mc,ec,tc,cc,ecc,nc,tce As New list(Of color)
        Dim xf As New list(Of meshface)

        If clr.count() = 0 Then clr.add(color.LightGray) Else biC = True

        If bm Then
          'Start Deconstruct if Mesh
          msh = G0

          mshe = msh.Duplicate()
          mtv = mshe.TopologyVertices()
          mte = mshe.TopologyEdges()
          mf = mshe.Faces()

          bnk = mshe.GetNakedEdgePointStatus()

          If G1 IsNot Nothing Then
            msha = G1

            If msh.Vertices.Count() <> msha.vertices.count() Then Exit Sub
          Else
            msha = msh.Offset(-d)
          End If

          msh.Append(msha)

          If i.count() = 0 Then I = Enumerable.Range(0, mf.Count()).ToList()

          mv = msh.Vertices().ToPoint3dArray().tolist()

          cf = I.Count()

          'Assign Colors
          If mshe.VertexColors.Count() < 1 Then
            mshe.VertexColors.CreateMonotoneMesh(color.LightGray)
            bmC = biC
          Else
            bmC = True
          End If

          If msha.VertexColors.Count() > 0 Then bmC = True

          mc = mshe.VertexColors().ToArray().ToList()
          If msha.VertexColors.count() < 1 Then mc.addrange(mc) Else mc.addrange(msha.VertexColors().ToArray().ToList())
        Else
          'Start Deconstruct if Curve
          crv = G0

          I.clear()
          I.add(0)
          Dim nbc As nurbscurve
          Dim pc As polyline
          Dim nps As Rhino.Geometry.Collections.NurbsCurvePointList

          nbc = crv.ToNurbsCurve()
          nps = nbc.Points
          pc = nbc.Points.ControlPolygon
          If (Not pc.IsClosed) Then pc.add(pc(0))
          av(0) = pc.CenterPoint

          msh.Vertices.AddVertices(pc.ToArray())
          msh.faces.addfaces(pc.TriangulateClosedPolyline())
          msh.Vertices.Remove(pc.count() - 1, True)

          mv = msh.Vertices.ToPoint3dArray().tolist()
          mte = msh.TopologyEdges()
          mtv = msh.TopologyVertices()

          ReDim bnk(mv.count() - 1)
          For j = 0 To mv.count() - 1 Step 1
            bnk(j) = True
          Next

          'Assign Colors
          If bic Then bmC = True

          If G1 IsNot Nothing Then
            crva = G1
            nbc = crva.ToNurbsCurve()
            nps = nbc.Points
            pc = nbc.Points.ControlPolygon
            If (Not pc.IsClosed) Then pc.add(pc(0))
            av(1) = pc.CenterPoint
            pc.RemoveAt(pc.count() - 1)

            If pc.count() <> mv.count() Then Exit Sub

            cf = 1
            mv.addrange(pc)
          Else
            Dim tcpt As point3d
            msh.Normals.ComputeNormals()
            msh.Normals.UnitizeNormals()
            k = mv.count()
            For j = 0 To k - 1 Step 1
              mv.add(mv.item(j) + msh.Normals(j) * d)
              tcpt += mv.item(j) + msh.Normals(j) * d
            Next

            cf = 1
            av(1) = tcpt / k
          End If
        End If

        ce = mte.count()
        cv = mv.count() / 2
        dcv = mv.count()

        If bm Then If msh.Faces.TriangleCount() > 0 Then Exit Sub
        If bp Then If cv <> 4 Then Exit Sub

        x = appendprepend(cv - 1)
        'Match variables and colors to vertex count
        If (T0.count()) < cv Then T0 = dblDList(matchDbl(T0, cv)) Else If (T0.count()) = cv Then T0.addrange(T0) Else If (T0.count()) < dcv Then T0 = matchDbl(T0, dcv)
        If (T1.count()) < cv Then T1 = dblDList(matchDbl(T1, cv)) Else If (T1.count()) = cv Then T1.addrange(T1) Else If (T1.count()) < dcv Then T1 = matchDbl(T1, dcv)
        If (T2.count()) < cv Then T2 = dblDList(matchDbl(T2, cv)) Else If (T2.count()) = cv Then T2.addrange(T2) Else If (T2.count()) < dcv Then T2 = matchDbl(T2, dcv)
        If (T3.count()) < cv Then T3 = dblDList(matchDbl(T3, cv)) Else If (T3.count()) = cv Then T3.addrange(T3) Else If (T3.count()) < dcv Then T3 = matchDbl(T3, dcv)
        If (clr.count()) < cv Then clr = dblCList(matchClr(clr, cv)) Else If (clr.count()) = cv Then clr.addrange(clr)Else If (clr.count()) < dcv Then clr = matchClr(clr, dcv)

        If bp Then
          mc = clr
          ac = colorCap(mc)
        End If

        'Edge based vertices
        k = 0
        Dim cpt As point3d
        Dim ccl As color
        Dim bce As Boolean

        Dim emsk(),vmsk(),ftv As Integer
        Dim tx() As Integer = Nothing
        ReDim emsk(ce - 1)
        ReDim vmsk(cv - 1)

        For j = 0 To cf - 1 Step 1
          If bm Then If mf(j).isquad() Then h = 3 Else h = 2 Else h = cv - 1
          y = appendPrepend(h)
          If bm Then tx = mf.GetTopologicalVertices(j)
          For k = 0 To h Step 1
            If bm Then
              ftv = mte.GetEdgeIndex(tx(y(k)), tx(y(k + 1)))
              ua = mtv.MeshVertexIndices(tx(y(k)))(0)
              va = mtv.MeshVertexIndices(tx(y(k + 1)))(0)
            Else
              ftv = y(k)
              ua = y(k)
              va = y(k + 1)
            End If
            ub = ua + cv
            vb = va + cv

            cpt = (mv(ua) + mv(va) + mv(ub) + mv(vb)) / 4
            ccl = avg4Clr(mc(ua), mc(va), mc(ub), mc(vb))
            If bm Then bce = mte.GetConnectedFaces(j).count() <> 2 Else bce = True

            If vmsk(ua) = 0 Then If k < 2 Then vmsk(ua) = 1 Else vmsk(ua) = 2
            If emsk(ftv) = 0 Then
              If k < 2 Then
                emsk(ftv) = 1

                ep.add(evalP(cpt, mv(va), t1(va)))
                ec.add(evalC(ccl, mc(va), t1(va)))
                en.add(bce)
                dir.add(-1)
                met.add(ua & "," & va & "," & 0, jj + 0)
                met.add(va & "," & ua & "," & 0, jj + 0)

                ep.add(evalP(cpt, mv(ub), t1(ub)))
                ec.add(evalC(ccl, mc(ub), t1(ub)))
                en.add(bce)
                dir.add(-1)
                met.add(vb & "," & ub & "," & 0, jj + 1)
                met.add(ub & "," & vb & "," & 0, jj + 1)

                ep.add(evalP(mv(ua), mv(va), t0(ua)))
                ec.add(evalC(mc(ua), mc(va), t0(ua)))
                en.add(bce)
                dir.add(-1)
                met.add(ua & "," & va & "," & 1, jj + 2)
                met.add(va & "," & ua & "," & 1, jj + 2)

                ep.add(evalP(mv(vb), mv(ub), t0(vb)))
                ec.add(evalC(mc(vb), mc(ub), t0(vb)))
                en.add(bce)
                dir.add(-1)
                met.add(vb & "," & ub & "," & 1, jj + 3)
                met.add(ub & "," & vb & "," & 1, jj + 3)

                jj += 4
              Else
                emsk(ftv) = 2

                ep.add(evalP(cpt, mv(ua), t1(ua)))
                ec.add(evalC(ccl, mc(ua), t1(ua)))
                en.add(bce)
                dir.add(-1)
                met.add(ua & "," & va & "," & 0, jj + 0)
                met.add(va & "," & ua & "," & 0, jj + 0)

                ep.add(evalP(cpt, mv(vb), t1(vb)))
                ec.add(evalC(ccl, mc(vb), t1(vb)))
                en.add(bce)
                dir.add(-1)
                met.add(vb & "," & ub & "," & 0, jj + 1)
                met.add(ub & "," & vb & "," & 0, jj + 1)

                ep.add(evalP(mv(va), mv(ua), t0(va)))
                ec.add(evalC(mc(va), mc(ua), t0(va)))
                en.add(bce)
                dir.add(-1)
                met.add(ua & "," & va & "," & 1, jj + 2)
                met.add(va & "," & ua & "," & 1, jj + 2)

                ep.add(evalP(mv(ub), mv(vb), t0(ub)))
                ec.add(evalC(mc(ub), mc(vb), t0(ub)))
                en.add(bce)
                dir.add(-1)
                met.add(vb & "," & ub & "," & 1, jj + 3)
                met.add(ub & "," & vb & "," & 1, jj + 3)

                jj += 4
              End If
            End If
          Next
        Next

        k = 0
        For j = 0 To ubound(bnk) Step 1
          dirv.add(-1)

          If vmsk(j) = 1 Then
            np.add(evalP(mv(j), mv(j + cv), t0(j)))
            nc.add(evalC(mc(j), mc(j + cv), t0(j)))
            mvv.add(j & "," & 0, k)
            mvv.add(j + cv & "," & 0, k)
          Else
            np.add(evalP(mv(j + cv), mv(j), t0(j + cv)))
            nc.add(evalC(mc(j + cv), mc(j), t0(j + cv)))
            mvv.add(j & "," & 0, k)
            mvv.add(j + cv & "," & 0, k)
          End If
          k += 1

          If bnk(j) Then
          End If
        Next
        'Face based vertices
        Dim xv(),mt(),ei(),xi() As Integer
        Dim tfv As point3d
        Dim xca(),xcb(),xta(),xtb(),tfc  As color
        Dim xn(1) As Double
        ReDim ei(6)
        ReDim xi(1)
        u = 1
        If bm Then v = ce * 4 + cf * 3 + cv Else v = cv * 4 + cf * 3 + cv

        For jj = 0 To I.count() - 1 Step 1
          Dim tcv As New point3d
          j = I(jj)
          w = v + tv.count()
          xn(0) = 0
          xn(1) = 0
          If bm Then
            If mf(j).isquad() Then h = 4 Else h = 3
            ReDim xv(h - 1)
            ReDim xca(h - 1)
            ReDim xcb(h - 1)
            ReDim xta(h - 1)
            ReDim xtb(h - 1)
            mt = mf.GetTopologicalVertices(j)
            For k = 0 To h - 1 Step 1
              xv(k) = mtv.MeshVertexIndices(mt(k))(0)
              xca(k) = mc(xv(k))
              xcb(k) = mc(xv(k) + cv)
              xta(k) = clr(xv(k))
              xtb(k) = clr(xv(k) + cv)
            Next
            av(0) = mf.GetFaceCenter(j)
            av(1) = msh.faces.GetFaceCenter(j + cf)
            ac(0) = avgClr(xca)
            ac(1) = avgClr(xcb)
            ax(0) = avgClr(xta)
            ax(1) = avgClr(xtb)
            If biC Then ac(2) = sumC(ax(0), ax(1)) Else ac(2) = sumC(ac(0), ac(1))
          Else
            h = cv
            xv = Enumerable.Range(0, h).ToArray()
          End If

          For k = 0 To h - 1 Step 1
            xn(0) += T3(xv(k))
            xn(1) += T3(xv(k) + cv)
          Next

          xn(0) /= h
          xn(1) /= h
          av(2) = (av(0) + av(1)) / 2
          y = appendprepend(h - 1)

          For k = 1 To h Step 1
            If bp Then
              xv(y(k)) = y(k)
              xv(y(k + 1)) = y(k + 1)
            End If
            ei(0) = met.item(xv(y(k)) & "," & xv(y(k + 1)) & "," & 0)
            ei(1) = met.item(xv(y(k)) + cv & "," & xv(y(k + 1)) + cv & "," & 0)
            ei(2) = met.item(xv(y(k)) & "," & xv(y(k + 1)) & "," & 1)
            ei(3) = met.item(xv(y(k)) + cv & "," & xv(y(k + 1)) + cv & "," & 1)

            tfv = (mv(xv(y(k))) + mv(xv(y(k + 1))) + mv(xv(y(k + 1)) + cv) + mv(xv(y(k)) + cv)) / 4
            tfc = avg4Clr(mc(xv(y(k))), mc(xv(y(k + 1))), mc(xv(y(k)) + cv), mc(xv(y(k + 1)) + cv))

            tv.add(evalP(tfv, av(2), (t3(xv(y(k))) + t3(xv(y(k + 1))) + t3(xv(y(k + 1)) + cv) + t3(xv(y(k)) + cv)) / 4))
            tc.add(evalC(tfc, ac(2), (t3(xv(y(k))) + t3(xv(y(k + 1))) + t3(xv(y(k + 1)) + cv) + t3(xv(y(k)) + cv)) / 4))

            'Define new per face vertices

            If (y(k) Mod 2) Then

              If k > 2 Then
                tve.add(evalP(mv(xv(y(k))), av(2), t2(xv(y(k)))))
                tce.add(evalC(mc(xv(y(k))), ac(2), t2(xv(y(k)))))
              Else
                tve.add(evalP(mv(xv(y(k)) + cv), av(2), t2(xv(y(k)) + cv)))
                tce.add(evalC(mc(xv(y(k)) + cv), ac(2), t2(xv(y(k)) + cv)))
              End If
            Else

              tve.add(evalP(mv(xv(y(k))), av(0), t1(xv(y(k)))))
              tce.add(evalC(mc(xv(y(k))), ac(0), t1(xv(y(k)))))

              tve.add(evalP(mv(xv(y(k)) + cv), av(1), t1(xv(y(k)) + cv)))
              tce.add(evalC(mc(xv(y(k)) + cv), ac(1), t1(xv(y(k)) + cv)))

            End If
            'Define new faces

            If k < 3 Then
              If k Mod 2 Then
                xf.add(New meshface(w + y(k), ei(0), v - cv + xv(y(2)), v + cf * h + j * 6 + 2))
                xf.add(New meshface(ei(0), w + y(k), ep.count() + j * 3 + 2, ei(2)))
                xf.add(New meshface(ei(1), w + y(k), v + cf * h + j * 6 + 2, ei(3)))
                xf.add(New meshface(w + y(k), ei(1), v - cv + xv(y(1 + (1 - (k Mod 2)) * 2)), ep.count() + j * 3 + 2))
                xf.add(New meshface(ep.count() + j * 3 + 1, v + cf * h + j * 6 + 0 + (1 - (k Mod 2)) * 3, ei(2), ep.count() + j * 3 + 2))
                xf.add(New meshface(ep.count() + j * 3 + 0, v + cf * h + j * 6 + 1 + (1 - (k Mod 2)) * 3, ei(3), v + cf * 4 + j * 6 + 2))
              Else
                xf.add(New meshface(ei(0), w + y(k), v + cf * h + j * 6 + 2, v - cv + xv(y(2))))
                xf.add(New meshface(w + y(k), ei(0), ei(2), ep.count() + j * 3 + 2))
                xf.add(New meshface(w + y(k), ei(1), ei(3), v + cf * h + j * 6 + 2))
                xf.add(New meshface(ei(1), w + y(k), ep.count() + j * 3 + 2, v - cv + xv(y(1 + (1 - (k Mod 2)) * 2))))
                xf.add(New meshface(v + cf * h + j * 6 + 0 + (1 - (k Mod 2)) * 3, ep.count() + j * 3 + 1, ep.count() + j * 3 + 2, ei(2)))
                xf.add(New meshface(v + cf * h + j * 6 + 1 + (1 - (k Mod 2)) * 3, ep.count() + j * 3 + 0, v + cf * 4 + j * 6 + 2, ei(3)))
              End If
            Else
              If k Mod 2 Then
                xf.add(New meshface(ei(0), w + y(k), v + cf * 4 + j * 6 + 5, ei(2)))
                xf.add(New meshface(w + y(k), ei(0), v - cv + xv(y(k + (1 - (k Mod 2)))), ep.count() + j * 3 + 2))
                xf.add(New meshface(ei(1), v - cv + xv(y(0)), v + cf * 4 + j * 6 + 5, w + y(k)))
                xf.add(New meshface(ei(1), w + y(k), ep.count() + j * 3 + 2, ei(3)))
                xf.add(New meshface(ep.count() + j * 3 + 0, v + cf * 4 + j * 6 + 1 + (k Mod 2) * 3, ei(3), ep.count() + j * 3 + 2))
                xf.add(New meshface(ep.count() + j * 3 + 1, v + cf * 4 + j * 6 + 0 + (k Mod 2) * 3, ei(2), v + cf * 4 + j * 6 + 5))
              Else
                xf.add(New meshface(w + y(k), ei(0), ei(2), v + cf * 4 + j * 6 + 5))
                xf.add(New meshface(ei(0), w + y(k), ep.count() + j * 3 + 2, v - cv + xv(y(k + (1 - (k Mod 2))))))
                xf.add(New meshface(v - cv + xv(y(0)), ei(1), w + y(k), v + cf * 4 + j * 6 + 5))
                xf.add(New meshface(w + y(k), ei(1), ei(3), ep.count() + j * 3 + 2))
                xf.add(New meshface(v + cf * 4 + j * 6 + 1 + (k Mod 2) * 3, ep.count() + j * 3 + 0, ep.count() + j * 3 + 2, ei(3)))
                xf.add(New meshface(v + cf * 4 + j * 6 + 0 + (k Mod 2) * 3, ep.count() + j * 3 + 1, v + cf * 4 + j * 6 + 5, ei(2)))
              End If
            End If

          Next
          fv.add(evalP(av(1), av(0), xn(0) / 2))
          cc.add(evalC(ac(1), ac(2), xn(0)))

          fv.add(evalP(av(0), av(1), xn(1) / 2))
          cc.add(evalC(ac(0), ac(2), xn(1)))

          fv.add(av(2))
          cc.add(ac(2))
        Next

        Dim om As New mesh
        om.Vertices.AddVertices(ep)
        If bmC Then om.VertexColors.AppendColors(ec.toarray())
        om.Vertices.AddVertices(fv)
        If bmC Then om.VertexColors.AppendColors(cc.toarray())
        om.Vertices.AddVertices(np)
        If bmC Then om.VertexColors.AppendColors(nc.toarray())

        om.Vertices.AddVertices(tv.toarray())
        If bmC Then om.VertexColors.AppendColors(tc.toarray())

        om.Vertices.AddVertices(tve.toarray())
        If bmC Then om.VertexColors.AppendColors(tce.toarray())

        om.Faces.AddFaces(xf.toarray())

        'If i.count() > 0 Then om.Vertices.CullUnused()

        A = om
      End If
    End If
# ---------- batwing: VB additional code ----------
  Private Function appendprepend(ByVal i As Integer)
    Dim srsEnum As IEnumerable(Of Integer) = Enumerable.Range(0, i + 1)
    Dim arrVal As New list(Of Integer)
    arrVal = srsEnum.tolist()
    arrVal.add(0)
    arrVal.insert(0, i)
    Return arrVal.toarray()
  End Function

  Private Function colorCap(ByVal c As list(Of color))
    Dim i,k As Integer
    k = c.count() / 2
    Dim r(2),g(2),b(2) As Integer
    For i = 0 To k - 1 Step 1
      r(0) += c.item(i).R
      r(1) += c.item(i + k).R
      g(0) += c.item(i).g
      g(1) += c.item(i + k).g
      b(0) += c.item(i).b
      b(1) += c.item(i + k).b
    Next

    r(0) = CInt(r(0) / k)
    r(1) = CInt(r(1) / k)
    g(0) = CInt(g(0) / k)
    g(1) = CInt(g(1) / k)
    b(0) = CInt(b(0) / k)
    b(1) = CInt(b(1) / k)

    r(2) = CInt((r(0) + r(1)) / 2)
    g(2) = CInt((g(0) + g(1)) / 2)
    b(2) = CInt((b(0) + b(1)) / 2)

    If r(0) > 255 Then r(0) = 255 Else If r(0) < 0 Then r(0) = 0
    If r(1) > 255 Then r(1) = 255 Else If r(1) < 0 Then r(1) = 0
    If g(0) > 255 Then g(0) = 255 Else If g(0) < 0 Then g(0) = 0
    If g(1) > 255 Then g(1) = 255 Else If g(1) < 0 Then g(1) = 0
    If b(0) > 255 Then b(0) = 255 Else If b(0) < 0 Then b(0) = 0
    If b(1) > 255 Then b(1) = 255 Else If b(1) < 0 Then b(1) = 0

    If r(2) > 255 Then r(2) = 255 Else If r(2) < 0 Then r(2) = 0
    If g(2) > 255 Then g(2) = 255 Else If g(2) < 0 Then g(2) = 0
    If b(2) > 255 Then b(2) = 255 Else If b(2) < 0 Then b(2) = 0

    Return {color.FromArgb(r(0), G(0), b(0)),color.FromArgb(r(1), G(1), b(1)),color.FromArgb(r(2), G(2), b(2))}
  End Function

  Private Function dblCList(ByVal a As list(Of color))
    a.addrange(a)
    Return a
  End Function

  Private Function dblDList(ByVal a As list(Of Double))
    a.addrange(a)
    Return a
  End Function

  Private Function matchDbl(ByVal a As list(Of Double), ByVal t As Integer)
    Dim i,k As Integer
    k = a.count()
    For i = 0 To ((t + 1) - k) - 1 Step 1
      a.add(a.item(k - 1))
    Next
    Return a
  End Function

  Private Function matchClr(ByVal a As list(Of Color), ByVal t As Integer)
    Dim i,k As Integer
    k = a.count()
    For i = 0 To ((t + 1) - k) - 1 Step 1
      a.add(a.item(k - 1))
    Next
    Return a
  End Function

  Private Function sumC(ByVal ca As Color, ByVal cb As Color)
    Dim r,g,b As Integer

    r = CInt((CInt(ca.R) + CInt(cb.R)) / 2)
    g = CInt((CInt(ca.g) + CInt(cb.g)) / 2)
    b = CInt((CInt(ca.b) + CInt(cb.b)) / 2)

    If r > 255 Then r = 255 Else If r < 0 Then r = 0
    If G > 255 Then G = 255 Else If G < 0 Then G = 0
    If b > 255 Then b = 255 Else If b < 0 Then b = 0

    Return color.FromArgb(r, G, b)
  End Function

  Private Function avg4Clr(ByVal ca As Color, ByVal cb As Color, ByVal cc As Color, ByVal cd As Color)
    Dim r,g,b As Integer

    r = CInt((CInt(ca.R) + CInt(cb.R) + CInt(cc.R) + CInt(cd.R)) / 4)
    g = CInt((CInt(ca.g) + CInt(cb.g) + CInt(cc.g) + CInt(cd.g)) / 4)
    b = CInt((CInt(ca.b) + CInt(cb.b) + CInt(cc.b) + CInt(cd.b)) / 4)

    If r > 255 Then r = 255 Else If r < 0 Then r = 0
    If G > 255 Then G = 255 Else If G < 0 Then G = 0
    If b > 255 Then b = 255 Else If b < 0 Then b = 0

    Return color.FromArgb(r, G, b)
  End Function

  Private Function evalP(ByVal op As point3d, ByVal tp As Point3d, ByVal t As Double)
    Return New point3d(op + (tp - op) * t)
  End Function

  Private Function evalV(ByVal ov As vector3d, ByVal tv As vector3d, ByVal t As Double)
    Return New vector3d(ov + (tv - ov) * t)
  End Function

  Private Function evalN(ByVal u As Double, ByVal v As Double, ByVal t As Double)
    Return u + (v - u) * t
  End Function

  Private Function avgVec(ByVal v() As vector3f)
    Dim i As Integer
    Dim tv As Vector3d

    For i = 0 To ubound(v) Step 1
      tv += v(i)
    Next
    tv /= (ubound(v) + 1)
    tv.Unitize()
    Return New vector3f(tv.X, tv.Y, tv.Z)
  End Function

  Private Function roundClr(ByVal r As Integer, ByVal G As Integer, ByVal b As Integer, ByVal i As Integer)
    r = CInt(r / i)
    G = CInt(G / i)
    b = CInt(b / i)

    If r > 255 Then r = 255 Else If r < 0 Then r = 0
    If G > 255 Then G = 255 Else If G < 0 Then G = 0
    If b > 255 Then b = 255 Else If b < 0 Then b = 0

    Return color.FromArgb(r, G, b)
  End Function

  Private Function avgClr(ByVal c() As color)
    Dim r,G,b As Integer
    Dim i,k As Integer

    k = ubound(c) + 1

    For i = 0 To k - 1 Step 1
      r += CInt(c(i).R)
      G += CInt(c(i).G)
      b += CInt(c(i).B)
    Next

    r = CInt(r / k)
    G = CInt(G / k)
    b = CInt(b / k)

    If r > 255 Then r = 255 Else If r < 0 Then r = 0
    If G > 255 Then G = 255 Else If G < 0 Then G = 0
    If b > 255 Then b = 255 Else If b < 0 Then b = 0

    Return color.FromArgb(r, G, b)
  End Function

  Private Function evalC(ByVal oc As color, ByVal tc As color, ByVal t As Double)
    Dim r,G,b As Integer
    r = CInt(CInt(oc.R) + (CInt(tc.R) - CInt(oc.R)) * t)
    G = CInt(CInt(oc.G) + (CInt(tc.G) - CInt(oc.G)) * t)
    b = CInt(CInt(oc.B) + (CInt(tc.B) - CInt(oc.B)) * t)

    If r > 255 Then r = 255 Else If r < 0 Then r = 0
    If G > 255 Then G = 255 Else If G < 0 Then G = 0
    If b > 255 Then b = 255 Else If b < 0 Then b = 0

    Return color.FromArgb(r, G, b)
  End Function

  ''' <summary>
  ''' This method will be called once every solution, before any calls to RunScript.
  ''' </summary>
  Public Overrides Sub BeforeRunScript()
  End Sub
  ''' <summary>
  ''' This method will be called once every solution, after any calls to RunScript.
  ''' </summary>
  Public Overrides Sub AfterRunScript()
  End Sub
# ---------- end batwing ----------
f_rd = FRD(T0=0.5, T1=0.75, T2=0.5, T3=0.75, D=1, C=False, R=False)  # -> out, A; inputs G0: GeometryBase, G1: GeometryBase, I: list, T0: list, T1: list, T2: list, T3: list, clr: list of Color
# ---------- f_rd: VB ----------
    Component.Params.Input(0).Name = "Mesh or Curve"
    Component.Params.Input(0).Description = "Open or closed mesh or curve"
    Component.Params.Input(1).Name = "Mesh or Curve"
    Component.Params.Input(1).Description = "Optional open or closed mesh or curve whose type should correspond to G0."
    Component.Params.Input(2).Name = "Index [Face]"
    Component.Params.Input(2).Description = "An optional integer or list of integers which specify the faces to be modified if the input is a mesh. If no value is supplied then all faces will be modified"
    Component.Params.Input(3).Name = "Vert to Face [Vertex]"
    Component.Params.Input(3).Description = "Evaluates a new vertex between the input geometry's vertex to the face center"
    Component.Params.Input(4).Name = "Along Edge [Vertex]"
    Component.Params.Input(4).Description = "Evaluates a new vertex along the input geometry's edge"
    Component.Params.Input(5).Name = "Face to Vol [Vertex]"
    Component.Params.Input(5).Description = "Evaluates a new vertex between the input geometry's face center to the volumetric center"
    Component.Params.Input(6).Name = "Vert to Vol [Vertex]"
    Component.Params.Input(6).Description = "Evaluates a new vertex between the input geometry's vertex to the volumetric center"
    Component.Params.Input(7).Name = "Distance"
    Component.Params.Input(7).Description = "An optional number to add depth if no input is provided for G1"
    Component.Params.Input(8).Name = "Close"
    Component.Params.Input(8).Description = "If true then additional faces and if needed vertices will be added to the mesh, closing the solid"
    Component.Params.Input(9).Name = "Invert"
    Component.Params.Input(9).Description = "If true the faces the close the mesh are reversed, flipping the solid/ void relationship"
    Component.Params.Input(10).Name = "Color [Vertex]"
    Component.Params.Input(10).Description = "(If applied to a mesh a list of colors corresponding to each mesh face, if applied to a curve, a list of colors corresponding to each control point plus an additonal color value for the new averaged center"

    Component.Params.Output(1).Name = "Mesh"
    Component.Params.Output(1).Description = "If successful, a valid mesh"

    If G0 IsNot Nothing Then

      Dim bG,bM, bP,bmC,biC As Boolean

      bM = G0.ObjectType = ObjectType.Mesh
      bP = G0.ObjectType = ObjectType.Curve

      bG = (bM Or bP)
      If G1 IsNot Nothing Then
        If bM And G1.ObjectType <> ObjectType.Mesh Then bG = False
        If bP And G1.ObjectType <> ObjectType.Curve Then bG = False
      End If

      If bG Then
        Dim msh,msha,mshe As New mesh
        Dim crv,crva As curve
        Dim av(2) As point3d
        Dim ac(2),ax(1) As color
        Dim h,j,jj,k,u,v,vv,ua,ub,va,vb,w,tcx As Integer
        Dim cv,cf,ce,dcv As Integer
        Dim x(),y() As Integer
        Dim bnk() As Boolean = Nothing

        Dim mv,xfv,fv,ep,tv,ecv,exp,np,xp As New list(Of Point3d)
        Dim mev,mvv,met As New dictionary(Of String, Integer)
        Dim mf As Rhino.Geometry.Collections.MeshFaceList = Nothing
        Dim mtv As Rhino.Geometry.Collections.MeshTopologyVertexList = Nothing
        Dim mte As Rhino.Geometry.Collections.MeshTopologyEdgeList = Nothing
        Dim ev As New list(Of vector3d)
        Dim ed As New list(Of Double)
        Dim en As New list(Of Boolean)
        Dim dir,dirv As New list(Of Integer)
        Dim mc,ec,tc,cc,xfc,fc,ecc,exc,nc,xc As New list(Of color)
        Dim xf As New list(Of meshface)

        Dim epo(),npo(),npc() As Point3d
        Dim eco(),nco(),ncc() As color

        If clr.count() = 0 Then clr.add(color.LightGray) Else biC = True

        If bm Then
          'Start Deconstruct if Mesh
          msh = G0

          mshe = msh.Duplicate()
          mtv = mshe.TopologyVertices()
          mte = mshe.TopologyEdges()
          mf = mshe.Faces()

          bnk = mshe.GetNakedEdgePointStatus()

          If G1 IsNot Nothing Then
            msha = G1

            If msh.Vertices.Count() <> msha.vertices.count() Then Exit Sub
          Else
            msha = msh.Offset(-d)
          End If

          msh.Append(msha)

          If i.count() = 0 Then I = Enumerable.Range(0, mf.Count()).ToList()

          mv = msh.Vertices().ToPoint3dArray().tolist()

          cf = I.Count()

          'Assign Colors
          If mshe.VertexColors.Count() < 1 Then
            mshe.VertexColors.CreateMonotoneMesh(color.LightGray)
            bmC = biC
          Else
            bmC = True
          End If

          If msha.VertexColors.Count() > 0 Then bmC = True

          mc = mshe.VertexColors().ToArray().ToList()
          If msha.VertexColors.count() < 1 Then mc.addrange(mc) Else mc.addrange(msha.VertexColors().ToArray().ToList())
        Else
          'Start Deconstruct if Curve
          crv = G0

          I.clear()
          I.add(0)
          Dim nbc As nurbscurve
          Dim pc As polyline
          Dim nps As Rhino.Geometry.Collections.NurbsCurvePointList

          nbc = crv.ToNurbsCurve()
          nps = nbc.Points
          pc = nbc.Points.ControlPolygon
          If (Not pc.IsClosed) Then pc.add(pc(0))
          av(0) = pc.CenterPoint

          msh.Vertices.AddVertices(pc.ToArray())
          msh.faces.addfaces(pc.TriangulateClosedPolyline())
          msh.Vertices.Remove(pc.count() - 1, True)

          mv = msh.Vertices.ToPoint3dArray().tolist()
          mte = msh.TopologyEdges()
          mtv = msh.TopologyVertices()

          ReDim bnk(mv.count() - 1)
          For j = 0 To mv.count() - 1 Step 1
            bnk(j) = True
          Next

          'Assign Colors
          If bic Then bmC = True

          If G1 IsNot Nothing Then
            crva = G1
            nbc = crva.ToNurbsCurve()
            nps = nbc.Points
            pc = nbc.Points.ControlPolygon
            If (Not pc.IsClosed) Then pc.add(pc(0))
            av(1) = pc.CenterPoint
            pc.RemoveAt(pc.count() - 1)

            If pc.count() <> mv.count() Then Exit Sub

            cf = 1
            mv.addrange(pc)
          Else
            Dim tcpt As point3d
            msh.Normals.ComputeNormals()
            msh.Normals.UnitizeNormals()
            k = mv.count()
            For j = 0 To k - 1 Step 1
              mv.add(mv.item(j) + msh.Normals(j) * d)
              tcpt += mv.item(j) + msh.Normals(j) * d
            Next

            cf = 1
            av(1) = tcpt / k
          End If

        End If
        ce = mte.count()
        cv = mv.count() / 2
        dcv = mv.count()

        x = appendprepend(cv - 1)
        'Match variables and colors to vertex count
        If (T0.count()) < cv Then T0 = dblDList(matchDbl(T0, cv)) Else If (T0.count()) = cv Then T0.addrange(T0) Else If (T0.count()) < dcv Then T0 = matchDbl(T0, dcv)
        If (T1.count()) < cv Then T1 = dblDList(matchDbl(T1, cv)) Else If (T1.count()) = cv Then T1.addrange(T1) Else If (T1.count()) < dcv Then T1 = matchDbl(T1, dcv)
        If (T2.count()) < cv Then T2 = dblDList(matchDbl(T2, cv)) Else If (T2.count()) = cv Then T2.addrange(T2) Else If (T2.count()) < dcv Then T2 = matchDbl(T2, dcv)
        If (T3.count()) < cv Then T3 = dblDList(matchDbl(T3, cv)) Else If (T3.count()) = cv Then T3.addrange(T3) Else If (T3.count()) < dcv Then T3 = matchDbl(T3, dcv)
        If (clr.count()) < cv Then clr = dblCList(matchClr(clr, cv)) Else If (clr.count()) = cv Then clr.addrange(clr)Else If (clr.count()) < dcv Then clr = matchClr(clr, dcv)

        If bp Then
          mc = clr
          ac = colorCap(mc)
        End If

        If biC Then fc = clr Else fc = mc

        'Edge based vertices
        k = 0
        Dim cpt As point3d
        Dim ccl As color
        Dim bce As Boolean
        Dim epat() As Integer
        ReDim epat(ce - 1)
        If bm Then
          For j = 0 To cf - 1 Step 1
            If bm Then If mf(j).isquad() Then h = 3 Else h = 2 Else h = cv - 1

            Dim mfe() As Integer
            mfe = mte.GetEdgesForFace(j)
            For k = 0 To h Step 1
              If epat(mfe(k)) = Nothing Then epat(mfe(k)) = k Mod 2
            Next
          Next
        Else
          For k = 0 To h Step 1
            epat(k) = k Mod 2
          Next
        End If

        k = 0
        jj = 0
        For j = 0 To ce - 1 Step 1
          If (bm Or (bp And (mte.GetConnectedFaces(j).Count() < 2))) Then
            ua = mtv.MeshVertexIndices(mte.GetTopologyVertices(j).I)(0)
            va = mtv.MeshVertexIndices(mte.GetTopologyVertices(j).J)(0)
            ub = ua + cv
            vb = va + cv

            cpt = (mv(ua) + mv(va) + mv(ub) + mv(vb)) / 4
            ccl = avg4Clr(mc(ua), mc(va), mc(ub), mc(vb))
            bce = mte.GetConnectedFaces(j).count() <> 2

            ep.add(evalP(cpt, mv(ua), t0(ua)))
            ec.add(evalC(ccl, mc(ua), t0(ua)))
            en.add(bce)
            dir.add(-1)
            mev.add(ua & "," & va & "," & 0, k)
            met.add(ua & "," & va & "," & 0, jj)

            ep.add(evalP(mv(va), mv(ua), t1(ua)))
            ec.add(evalC(mc(va), mc(ua), t1(ua)))
            en.add(bce)
            dir.add(-1)
            mev.add(ua & "," & va & "," & 1, k + 1)
            met.add(ua & "," & va & "," & 1, jj + 1)

            ep.add(evalP(cpt, mv(ub), t0(ub)))
            ec.add(evalC(ccl, mc(ub), t0(ub)))
            en.add(bce)
            mev.add(ub & "," & vb & "," & 0, k + 2)
            met.add(ub & "," & vb & "," & 0, jj + 2)

            ep.add(evalP(mv(vb), mv(ub), t1(ub)))
            ec.add(evalC(mc(vb), mc(ub), t1(ub)))
            en.add(bce)
            dir.add(-1)
            mev.add(ub & "," & vb & "," & 1, k + 3)
            met.add(ub & "," & vb & "," & 1, jj + 3)


            ep.add(evalP(cpt, mv(vb), t0(vb)))
            ec.add(evalC(ccl, mc(vb), t0(vb)))
            en.add(bce)
            dir.add(-1)
            mev.add(vb & "," & ub & "," & 0, k + 4)
            met.add(vb & "," & ub & "," & 0, jj)

            ep.add(evalP(mv(ub), mv(vb), t1(vb)))
            ec.add(evalC(mc(ub), mc(vb), t1(vb)))
            en.add(bce)
            dir.add(-1)
            mev.add(vb & "," & ub & "," & 1, k + 5)
            met.add(vb & "," & ub & "," & 1, jj + 1)

            ep.add(evalP(cpt, mv(va), t0(va)))
            ec.add(evalC(ccl, mc(va), t0(va)))
            en.add(bce)
            dir.add(-1)
            mev.add(va & "," & ua & "," & 0, k + 6)
            met.add(va & "," & ua & "," & 0, jj + 3)

            ep.add(evalP(mv(ua), mv(va), t1(va)))
            ec.add(evalC(mc(ua), mc(va), t1(va)))
            en.add(bce)
            dir.add(-1)
            mev.add(va & "," & ua & "," & 1, k + 7)
            met.add(va & "," & ua & "," & 1, jj + 2)

            exp.add(cpt)
            exc.add(ccl)

            k += 8
            jj += 4
          End If
        Next

        If bp Then ce = cv
        ReDim epo(ce * 4 - 1)
        ReDim eco(ce * 4 - 1)
        ReDim npo(cv - 1)
        ReDim nco(cv - 1)
        ReDim npc(cv - 1)
        ReDim ncc(cv - 1)

        k = 0
        For j = 0 To ubound(bnk) Step 1
          dirv.add(-1)
          xp.add(mv(j))
          xc.add(mc(j))
          xp.add(mv(j + cv))
          xc.add(mc(j + cv))

          np.add(evalP(mv(j + cv), mv(j), t1(j)))
          nc.add(evalC(mc(j + cv), mc(j), t1(j)))
          mvv.add(j & "," & 0, k)

          np.add(evalP(mv(j), mv(j + cv), t1(j + cv)))
          nc.add(evalC(mc(j), mc(j + cv), t1(j + cv)))
          mvv.add(j + cv & "," & 0, k + 1)

          k += 2

          If bnk(j) Then
          End If
        Next

        'Face based vertices
        Dim xv(),mt(),ei(),xi() As Integer
        Dim xca(),xcb(),xta(),xtb() As color
        Dim xn(1) As Double
        ReDim ei(9)
        ReDim xi(1)
        u = 3
        v = ubound(epo) + 1 + cf * 2 + npo.count()
        If c Then
          vv = ubound(npo) + 1 + cf * 2
          If r Then
            v += ubound(npc) + 1 + ce + cf * 2
          Else
            v += ubound(npc) + 1
          End If
        End If

        For jj = 0 To I.count() - 1 Step 1
          Dim tcv As New point3d
          Dim bmf As Boolean
          j = I(jj)
          w = v + tv.count()
          xn(0) = 0
          xn(1) = 0
          If bm Then
            If mf(j).isquad() Then h = 4 Else h = 3
            ReDim xv(h - 1)
            ReDim xca(h - 1)
            ReDim xcb(h - 1)
            ReDim xta(h - 1)
            ReDim xtb(h - 1)
            mt = mf.GetTopologicalVertices(j)
            For k = 0 To h - 1 Step 1
              xv(k) = mtv.MeshVertexIndices(mt(k))(0)
              xca(k) = mc(xv(k))
              xcb(k) = mc(xv(k) + cv)
              xta(k) = clr(xv(k))
              xtb(k) = clr(xv(k) + cv)
            Next
            av(0) = mf.GetFaceCenter(j)
            av(1) = msh.faces.GetFaceCenter(j + cf)
            ac(0) = avgClr(xca)
            ac(1) = avgClr(xcb)
            ax(0) = avgClr(xta)
            ax(1) = avgClr(xtb)
            If biC Then ac(2) = sumC(ax(0), ax(1)) Else ac(2) = sumC(ac(0), ac(1))
            bmf = mf(j).isquad()
          Else
            If ((cv + 1) Mod 2) Then bmf = True
            h = cv
            xv = Enumerable.Range(0, h).ToArray()
          End If

          For k = 0 To h - 1 Step 1
            xn(0) += T2(xv(k))
            xn(1) += T2(xv(k) + cv)
          Next

          xn(0) /= h
          xn(1) /= h
          av(2) = (av(0) + av(1)) / 2
          y = appendprepend(h - 1)

          For k = 1 To h Step 1
            ei(0) = met.item(xv(y(k)) & "," & xv(y(k + 1)) & "," & 0)
            ei(1) = met.item(xv(y(k + 1)) & "," & xv(y(k)) & "," & 0)
            ei(2) = met.item(xv(y(k)) & "," & xv(y(k + 1)) & "," & 1)
            ei(3) = met.item(xv(y(k + 1)) & "," & xv(y(k)) & "," & 1)
            ei(8) = met.item(xv(y(k)) & "," & xv(y(k - 1)) & "," & 1)

            If ((dirv(xv(y(k))) < 0) Or (dirv(xv(y(k + 1))) < 0)) Then
              If ((dirv(xv(y(k))) < 0) And (dirv(xv(y(k + 1))) < 0)) Then
                If (k Mod 2) Then
                  dirv(xv(y(k))) = 0
                  dirv(xv(y(k + 1))) = 1
                Else
                  dirv(xv(y(k))) = 1
                  dirv(xv(y(k + 1))) = 0
                End If
              Else
                If dirv(xv(y(k))) = 0 Then dirv(xv(y(k + 1))) = 1 Else dirv(xv(y(k + 1))) = 0
                If dirv(xv(y(k + 1))) = 0 Then dirv(xv(y(k))) = 1 Else dirv(xv(y(k))) = 0
              End If
              npo(xv(y(k))) = np(mvv.item(xv(y(k)) + dirv(xv(y(k))) * cv & "," & 0))
              nco(xv(y(k))) = nc(mvv.item(xv(y(k)) + dirv(xv(y(k))) * cv & "," & 0))
              npo(xv(y(k + 1))) = np(mvv.item(xv(y(k + 1)) + dirv(xv(y(k + 1))) * cv & "," & 0))
              nco(xv(y(k + 1))) = nc(mvv.item(xv(y(k + 1)) + dirv(xv(y(k + 1))) * cv & "," & 0))

              If r Then
                npc(xv(y(k))) = xp(mvv.item(xv(y(k)) + (1 - dirv(xv(y(k)))) * cv & "," & 0))
                ncc(xv(y(k))) = xc(mvv.item(xv(y(k)) + (1 - dirv(xv(y(k)))) * cv & "," & 0))
                npc(xv(y(k + 1))) = xp(mvv.item(xv(y(k + 1)) + (1 - dirv(xv(y(k + 1)))) * cv & "," & 0))
                ncc(xv(y(k + 1))) = xc(mvv.item(xv(y(k + 1)) + (1 - dirv(xv(y(k + 1)))) * cv & "," & 0))
              Else
                npc(xv(y(k))) = xp(mvv.item(xv(y(k)) + dirv(xv(y(k))) * cv & "," & 0))
                ncc(xv(y(k))) = xc(mvv.item(xv(y(k)) + dirv(xv(y(k))) * cv & "," & 0))
                npc(xv(y(k + 1))) = xp(mvv.item(xv(y(k + 1)) + dirv(xv(y(k + 1))) * cv & "," & 0))
                ncc(xv(y(k + 1))) = xc(mvv.item(xv(y(k + 1)) + dirv(xv(y(k + 1))) * cv & "," & 0))
              End If
            End If

            If dir(ei(0)) < 0 Then
              dir(ei(0)) = 0

              ei(4) = mev.item(xv(y(k)) + dirv(xv(y(k))) * cv & "," & xv(y(k + 1)) + dirv(xv(y(k))) * cv & "," & 0)
              ei(5) = mev.item(xv(y(k + 1)) + dirv(xv(y(k + 1))) * cv & "," & xv(y(k)) + dirv(xv(y(k + 1))) * cv & "," & 0)
              ei(6) = mev.item(xv(y(k)) + dirv(xv(y(k))) * cv & "," & xv(y(k + 1)) + dirv(xv(y(k))) * cv & "," & 1)
              ei(7) = mev.item(xv(y(k + 1)) + dirv(xv(y(k + 1))) * cv & "," & xv(y(k)) + dirv(xv(y(k + 1))) * cv & "," & 1)

              epo(ei(0)) = (ep(ei(4)))
              eco(ei(0)) = (ec(ei(4)))

              epo(ei(1)) = (ep(ei(5)))
              eco(ei(1)) = (ec(ei(5)))

              epo(ei(2)) = (ep(ei(6)))
              eco(ei(2)) = (ec(ei(6)))

              epo(ei(3)) = (ep(ei(7)))
              eco(ei(3)) = (ec(ei(7)))

            End If

            'Define new per face vertices
            tv.add(evalP(av(dirv(xv(y(k))) Mod 2), mv(xv(y(k)) + dirv(xv(y(k))) * cv), t0(xv(y(k)) + dirv(xv(y(k))) * cv)))
            tc.add(evalC(ac(dirv(xv(y(k))) Mod 2), mc(xv(y(k)) + dirv(xv(y(k))) * cv), t0(xv(y(k)) + dirv(xv(y(k))) * cv)))

            tv.add(evalP(mv(xv(y(k)) + (1 - dirv(xv(y(k)))) * cv), av(2), t3(xv(y(k)) + (1 - dirv(xv(y(k)))) * cv)))
            tc.add(evalC(mc(xv(y(k)) + (1 - dirv(xv(y(k)))) * cv), ac(2), t3(xv(y(k)) + (1 - dirv(xv(y(k)))) * cv)))

            tv.add(evalP((mv(xv(y(k))) + mv(xv(y(k + 1))) + mv(xv(y(k + 1)) + cv) + mv(xv(y(k)) + cv)) / 4, av(2), (t2(xv(y(k))) + t2(xv(y(k + 1))) + t2(xv(y(k + 1)) + cv) + t2(xv(y(k)) + cv)) / 4))
            tc.add(evalC(avg4Clr(mc(xv(y(k))), mc(xv(y(k + 1))), mc(xv(y(k)) + cv), mc(xv(y(k + 1)) + cv)), ac(2), (t2(xv(y(k))) + t2(xv(y(k + 1))) + t2(xv(y(k + 1)) + cv) + t2(xv(y(k)) + cv)) / 4))

            'Define new faces
            If bmf Then

              If k Mod 2 Then
                xf.add(New meshface(ei(0), ei(2), w + y(k + 1) * u + 1, w + y(k) * u + 2))
                xf.add(New meshface(ei(0), w + y(k) * u + 2, w + y(k) * u + 1, v - cf * 2 - npo.count() + xv(y(k))))
                xf.add(New meshface(ei(2), w + y(k) * u + 0, v - cf * 2 + j * 2 + (1 - dirv(xv(y(k)))), w + y(k + 1) * u + 1))

                xf.add(New meshface(v - cf * 2 - npo.count() + xv(y(k + 1)), ei(1), w + y(k) * u + 2, w + y(k + 1) * u + 1))
                xf.add(New meshface(w + y(k) * u + 2, ei(1), ei(3), w + y(k) * u + 1))
                xf.add(New meshface(ei(3), w + y(k + 1) * u + 0, v - cf * 2 + j * 2 + dirv(xv(y(k))), w + y(k) * u + 1))

                If c Then
                  tcx = mte.GetEdgeIndex(mtv.TopologyVertexIndex(xv(y(k))), mtv.TopologyVertexIndex(xv(y(k + 1))))
                  If r Then
                    xf.add(New meshface(ei(3), v - vv - cf * 2 - cv + xv(y(k)), v - vv - cf * 2 + j * 2 + (1 - dirv(xv(y(k)))), w + y(k + 1) * u + 0))
                    xf.add(New meshface(ei(2), v - vv - cf * 2 - cv + xv(y(k + 1)), v - vv - cf * 2 + j * 2 + dirv(xv(y(k))), w + y(k) * u + 0))

                    If mte.GetConnectedFaces(tcx).count() <> 2 Then
                      xf.add(New meshface(ei(2), ei(0), v - vv - cf * 2 - cv - ce + tcx, v - vv - cf * 2 - cv + xv(y(k + 1))))
                      xf.add(New meshface(ei(1), v - cf * 2 - npo.count() + xv(y(k + 1)), v - vv - cf * 2 - cv + xv(y(k + 1)), v - vv - cf * 2 - cv - ce + tcx))
                      xf.add(New meshface(ei(3), ei(1), v - vv - cf * 2 - cv - ce + tcx, v - vv - cf * 2 - cv + xv(y(k))))
                      xf.add(New meshface(ei(0), v - cf * 2 - npo.count() + xv(y(k)), v - vv - cf * 2 - cv + xv(y(k)), v - vv - cf * 2 - cv - ce + tcx))
                    End If

                  Else
                    xf.add(New meshface(w + y(k) * u + 0, ei(2), v - vv - cv + xv(y(k)), ei(8)))

                    If mte.GetConnectedFaces(tcx).count() <> 2 Then
                      xf.add(New meshface(ei(0), v - cf * 2 - npo.count() + xv(y(k)), v - vv - cv + xv(y(k)), ei(2)))
                      xf.add(New meshface(ei(1), v - cf * 2 - npo.count() + xv(y(k + 1)), v - vv - cv + xv(y(k + 1)), ei(3)))
                    End If

                  End If

                End If
              Else

                xf.add(New meshface(ei(2), ei(0), w + y(k) * u + 2, w + y(k + 1) * u + 1))
                xf.add(New meshface(w + y(k) * u + 2, ei(0), v - cf * 2 - npo.count() + xv(y(k)), w + y(k) * u + 1))
                xf.add(New meshface(w + y(k) * u + 0, ei(2), w + y(k + 1) * u + 1, v - cf * 2 + j * 2 + (1 - dirv(xv(y(k))))))

                xf.add(New meshface(ei(1), v - cf * 2 - npo.count() + xv(y(k + 1)), w + y(k + 1) * u + 1, w + y(k) * u + 2))
                xf.add(New meshface(ei(1), w + y(k) * u + 2, w + y(k) * u + 1, ei(3)))
                xf.add(New meshface(w + y(k + 1) * u + 0, ei(3), w + y(k) * u + 1, v - cf * 2 + j * 2 + dirv(xv(y(k)))))
                If c Then
                  tcx = mte.GetEdgeIndex(mtv.TopologyVertexIndex(xv(y(k))), mtv.TopologyVertexIndex(xv(y(k + 1))))
                  If r Then
                    xf.add(New meshface(v - vv - cf * 2 - cv + xv(y(k)), ei(3), w + y(k + 1) * u + 0, v - vv - cf * 2 + j * 2 + (1 - dirv(xv(y(k))))))
                    xf.add(New meshface(v - vv - cf * 2 - cv + xv(y(k + 1)), ei(2), w + y(k) * u + 0, v - vv - cf * 2 + j * 2 + dirv(xv(y(k)))))

                    If mte.GetConnectedFaces(tcx).count() <> 2 Then
                      xf.add(New meshface(ei(0), ei(2), v - vv - cf * 2 - cv + xv(y(k + 1)), v - vv - cf * 2 - cv - ce + tcx))
                      xf.add(New meshface(v - cf * 2 - npo.count() + xv(y(k + 1)), ei(1), v - vv - cf * 2 - cv - ce + tcx, v - vv - cf * 2 - cv + xv(y(k + 1))))
                      xf.add(New meshface(ei(1), ei(3), v - vv - cf * 2 - cv + xv(y(k)), v - vv - cf * 2 - cv - ce + tcx))
                      xf.add(New meshface(v - cf * 2 - npo.count() + xv(y(k)), ei(0), v - vv - cf * 2 - cv - ce + tcx, v - vv - cf * 2 - cv + xv(y(k))))

                    End If
                  Else
                    xf.add(New meshface(ei(2), w + y(k) * u + 0, ei(8), v - vv - cv + xv(y(k))))

                    If mte.GetConnectedFaces(tcx).count() <> 2 Then
                      xf.add(New meshface(v - cf * 2 - npo.count() + xv(y(k)), ei(0), ei(2), v - vv - cv + xv(y(k))))
                      xf.add(New meshface(v - cf * 2 - npo.count() + xv(y(k + 1)), ei(1), ei(3), v - vv - cv + xv(y(k + 1))))
                    End If
                  End If
                End If
              End If

            End If
          Next
          fv.add(evalP(av(1), av(2), xn(1)))
          cc.add(evalC(ac(1), ac(2), xn(1)))

          fv.add(evalP(av(0), av(2), xn(0)))
          cc.add(evalC(ac(0), ac(2), xn(0)))

          If bmf Then
            If (c And r) Then
              xfv.add(av(0))
              xfc.add(ac(0))

              xfv.add(av(1))
              xfc.add(ac(1))
            End If
          End If

        Next

        Dim om As New mesh
        om.Vertices.AddVertices(epo)
        If bmC Then om.VertexColors.AppendColors(eco)

        If c Then
          If r Then
            om.Vertices.AddVertices(exp)
            If bmC Then om.VertexColors.AppendColors(exc.toarray())
            om.Vertices.AddVertices(npc)
            If bmC Then om.VertexColors.AppendColors(ncc.toarray())
            om.Vertices.AddVertices(xfv)
            If bmC Then om.VertexColors.AppendColors(xfc.toarray())
          Else
            om.Vertices.AddVertices(npc)
            If bmC Then om.VertexColors.AppendColors(ncc.toarray())
          End If
        End If

        om.Vertices.AddVertices(npo)
        If bmC Then om.VertexColors.AppendColors(nco)
        om.Vertices.AddVertices(fv)
        If bmC Then om.VertexColors.AppendColors(cc.toarray())

        om.Vertices.AddVertices(tv.toarray())
        If bmC Then om.VertexColors.AppendColors(tc.toarray())

        om.Faces.AddFaces(xf.toarray())

        If (c And r) Then om.Flip(True, True, True)

        'If i.count() > 0 Then om.Vertices.CullUnused()

        A = om
      End If
    End If
# ---------- f_rd: VB additional code ----------
  Private Function appendprepend(ByVal i As Integer)
    Dim srsEnum As IEnumerable(Of Integer) = Enumerable.Range(0, i + 1)
    Dim arrVal As New list(Of Integer)
    arrVal = srsEnum.tolist()
    arrVal.add(0)
    arrVal.insert(0, i)
    Return arrVal.toarray()
  End Function

  Private Function colorCap(ByVal c As list(Of color))
    Dim i,k As Integer
    k = c.count() / 2
    Dim r(2),g(2),b(2) As Integer
    For i = 0 To k - 1 Step 1
      r(0) += c.item(i).R
      r(1) += c.item(i + k).R
      g(0) += c.item(i).g
      g(1) += c.item(i + k).g
      b(0) += c.item(i).b
      b(1) += c.item(i + k).b
    Next

    r(0) = CInt(r(0) / k)
    r(1) = CInt(r(1) / k)
    g(0) = CInt(g(0) / k)
    g(1) = CInt(g(1) / k)
    b(0) = CInt(b(0) / k)
    b(1) = CInt(b(1) / k)

    r(2) = CInt((r(0) + r(1)) / 2)
    g(2) = CInt((g(0) + g(1)) / 2)
    b(2) = CInt((b(0) + b(1)) / 2)

    If r(0) > 255 Then r(0) = 255 Else If r(0) < 0 Then r(0) = 0
    If r(1) > 255 Then r(1) = 255 Else If r(1) < 0 Then r(1) = 0
    If g(0) > 255 Then g(0) = 255 Else If g(0) < 0 Then g(0) = 0
    If g(1) > 255 Then g(1) = 255 Else If g(1) < 0 Then g(1) = 0
    If b(0) > 255 Then b(0) = 255 Else If b(0) < 0 Then b(0) = 0
    If b(1) > 255 Then b(1) = 255 Else If b(1) < 0 Then b(1) = 0

    If r(2) > 255 Then r(2) = 255 Else If r(2) < 0 Then r(2) = 0
    If g(2) > 255 Then g(2) = 255 Else If g(2) < 0 Then g(2) = 0
    If b(2) > 255 Then b(2) = 255 Else If b(2) < 0 Then b(2) = 0

    Return {color.FromArgb(r(0), G(0), b(0)),color.FromArgb(r(1), G(1), b(1)),color.FromArgb(r(2), G(2), b(2))}
  End Function

  Private Function dblCList(ByVal a As list(Of color))
    a.addrange(a)
    Return a
  End Function

  Private Function dblDList(ByVal a As list(Of Double))
    a.addrange(a)
    Return a
  End Function

  Private Function matchDbl(ByVal a As list(Of Double), ByVal t As Integer)
    Dim i,k As Integer
    k = a.count()
    For i = 0 To ((t + 1) - k) - 1 Step 1
      a.add(a.item(k - 1))
    Next
    Return a
  End Function

  Private Function matchClr(ByVal a As list(Of Color), ByVal t As Integer)
    Dim i,k As Integer
    k = a.count()
    For i = 0 To ((t + 1) - k) - 1 Step 1
      a.add(a.item(k - 1))
    Next
    Return a
  End Function

  Private Function sumC(ByVal ca As Color, ByVal cb As Color)
    Dim r,g,b As Integer

    r = CInt((CInt(ca.R) + CInt(cb.R)) / 2)
    g = CInt((CInt(ca.g) + CInt(cb.g)) / 2)
    b = CInt((CInt(ca.b) + CInt(cb.b)) / 2)

    If r > 255 Then r = 255 Else If r < 0 Then r = 0
    If G > 255 Then G = 255 Else If G < 0 Then G = 0
    If b > 255 Then b = 255 Else If b < 0 Then b = 0

    Return color.FromArgb(r, G, b)
  End Function

  Private Function avg4Clr(ByVal ca As Color, ByVal cb As Color, ByVal cc As Color, ByVal cd As Color)
    Dim r,g,b As Integer

    r = CInt((CInt(ca.R) + CInt(cb.R) + CInt(cc.R) + CInt(cd.R)) / 4)
    g = CInt((CInt(ca.g) + CInt(cb.g) + CInt(cc.g) + CInt(cd.g)) / 4)
    b = CInt((CInt(ca.b) + CInt(cb.b) + CInt(cc.b) + CInt(cd.b)) / 4)

    If r > 255 Then r = 255 Else If r < 0 Then r = 0
    If G > 255 Then G = 255 Else If G < 0 Then G = 0
    If b > 255 Then b = 255 Else If b < 0 Then b = 0

    Return color.FromArgb(r, G, b)
  End Function

  Private Function evalP(ByVal op As point3d, ByVal tp As Point3d, ByVal t As Double)
    Return New point3d(op + (tp - op) * t)
  End Function

  Private Function evalV(ByVal ov As vector3d, ByVal tv As vector3d, ByVal t As Double)
    Return New vector3d(ov + (tv - ov) * t)
  End Function

  Private Function evalN(ByVal u As Double, ByVal v As Double, ByVal t As Double)
    Return u + (v - u) * t
  End Function

  Private Function avgVec(ByVal v() As vector3f)
    Dim i As Integer
    Dim tv As Vector3d

    For i = 0 To ubound(v) Step 1
      tv += v(i)
    Next
    tv /= (ubound(v) + 1)
    tv.Unitize()
    Return New vector3f(tv.X, tv.Y, tv.Z)
  End Function

  Private Function roundClr(ByVal r As Integer, ByVal G As Integer, ByVal b As Integer, ByVal i As Integer)
    r = CInt(r / i)
    G = CInt(G / i)
    b = CInt(b / i)

    If r > 255 Then r = 255 Else If r < 0 Then r = 0
    If G > 255 Then G = 255 Else If G < 0 Then G = 0
    If b > 255 Then b = 255 Else If b < 0 Then b = 0

    Return color.FromArgb(r, G, b)
  End Function

  Private Function avgClr(ByVal c() As color)
    Dim r,G,b As Integer
    Dim i,k As Integer

    k = ubound(c) + 1

    For i = 0 To k - 1 Step 1
      r += CInt(c(i).R)
      G += CInt(c(i).G)
      b += CInt(c(i).B)
    Next

    r = CInt(r / k)
    G = CInt(G / k)
    b = CInt(b / k)

    If r > 255 Then r = 255 Else If r < 0 Then r = 0
    If G > 255 Then G = 255 Else If G < 0 Then G = 0
    If b > 255 Then b = 255 Else If b < 0 Then b = 0

    Return color.FromArgb(r, G, b)
  End Function

  Private Function evalC(ByVal oc As color, ByVal tc As color, ByVal t As Double)
    Dim r,G,b As Integer
    r = CInt(CInt(oc.R) + (CInt(tc.R) - CInt(oc.R)) * t)
    G = CInt(CInt(oc.G) + (CInt(tc.G) - CInt(oc.G)) * t)
    b = CInt(CInt(oc.B) + (CInt(tc.B) - CInt(oc.B)) * t)

    If r > 255 Then r = 255 Else If r < 0 Then r = 0
    If G > 255 Then G = 255 Else If G < 0 Then G = 0
    If b > 255 Then b = 255 Else If b < 0 Then b = 0

    Return color.FromArgb(r, G, b)
  End Function

  ''' <summary>
  ''' This method will be called once every solution, before any calls to RunScript.
  ''' </summary>
  Public Overrides Sub BeforeRunScript()
  End Sub
  ''' <summary>
  ''' This method will be called once every solution, after any calls to RunScript.
  ''' </summary>
  Public Overrides Sub AfterRunScript()
  End Sub
# ---------- end f_rd ----------
rotate_grid = Slider(0, range=0..360)
mdf_divisions = Slider(20, range=0..25)
height_of_mdf = Slider(35, range=0..50)
acrylic_divisions = Slider(20, range=0..25)
mdf_thickness = Slider(2, range=0..20)
acrylic_thickness = Slider(2.58, range=0..20)
height_of_acrylic = Slider(35, range=0..50)
# Parameters
surface = Surface(<surface referenced from the Rhino model>)
bounding_box = BoundingBox(Content=surface, Plane=PlaneXY(0, 0, 0))  # -> Box, Box_2

volume = Volume(Geometry=bounding_box.Box)  # -> Volume, Centroid
unit_z = UnitZ(Factor=10)
move = Move(Geometry=volume.Centroid, Motion=unit_z)  # -> Geometry, Transform
line = Line(StartPoint=volume.Centroid, EndPoint=move.Geometry)

rotate_axis = RotateAxis(Geometry=bounding_box.Box, Angle=degrees(rotate_grid), Axis=line)  # -> Geometry, Transform
box_corners = BoxCorners(Box=rotate_axis.Geometry)  # -> CornerA, CornerB, CornerC, CornerD, CornerE, CornerF, CornerG, CornerH
distance = Distance(PointA=box_corners.CornerA, PointB=box_corners.CornerE)
line_2 = Line(StartPoint=box_corners.CornerA, EndPoint=box_corners.CornerB)
line_3 = Line(StartPoint=box_corners.CornerD, EndPoint=box_corners.CornerA)
line_4 = Line(StartPoint=box_corners.CornerC, EndPoint=box_corners.CornerD)
line_5 = Line(StartPoint=box_corners.CornerB, EndPoint=box_corners.CornerC)
divide_curve = DivideCurve(Curve=line_5, Count=acrylic_divisions, Kinks=False)  # -> Points, Tangents, Parameters
divide_curve_2 = DivideCurve(Curve=line_4, Count=mdf_divisions, Kinks=False)  # -> reverse(Points), Tangents, Parameters
divide_curve_3 = DivideCurve(Curve=line_2, Count=mdf_divisions, Kinks=False)  # -> Points, Tangents, Parameters
divide_curve_4 = DivideCurve(Curve=line_3, Count=acrylic_divisions, Kinks=False)  # -> reverse(Points), Tangents, Parameters
line_6 = Line(StartPoint=divide_curve.Points, EndPoint=divide_curve_4.Points)
line_7 = Line(StartPoint=divide_curve_3.Points, EndPoint=divide_curve_2.Points)
list_length = ListLength(List=line_6)
list_length_2 = ListLength(List=line_7)
series = Series(Start=0, Step=1, Count=list_length)
series_2 = Series(Start=0, Step=1, Count=list_length_2)
list_item = ListItem(List=line_7, Index=series_2, Wrap=True)
list_item_2 = ListItem(List=line_6, Index=series, Wrap=True)
unit_z_2 = UnitZ(Factor=distance)
extrude = Extrude(Base=list_item, Direction=unit_z_2)
extrude_2 = Extrude(Base=list_item_2, Direction=unit_z_2)
area = Area(Geometry=extrude_2)  # -> Area, Centroid
area_2 = Area(Geometry=extrude)  # -> Area, Centroid
brep_brep = BrepBrep(BrepA=extrude, BrepB=surface)  # -> Curves, Points
brep_brep_2 = BrepBrep(BrepA=extrude_2, BrepB=surface)  # -> Curves, Points
xz_plane = XZPlane(Origin=area.Centroid)
yz_plane = YZPlane(Origin=area_2.Centroid)
unit_z_3 = UnitZ(Factor=height_of_mdf)
unit_z_4 = UnitZ(Factor=height_of_acrylic)
extrude_3 = Extrude(Base=brep_brep_2.Curves, Direction=unit_z_4)
extrude_4 = Extrude(Base=brep_brep.Curves, Direction=unit_z_3)
offset_brep = OffsetBrep(Brep=extrude_4, Distance=expr("x/2", mdf_thickness), Solid=True, BothSides=True, RoundCorners=False, MergeFaces=False)  # -> simplify(Brep)
offset_brep_2 = OffsetBrep(
    Brep=extrude_3,
    Distance=expr("x/2", acrylic_thickness),
    Solid=True,
    BothSides=True,
    RoundCorners=False,
    MergeFaces=False)  # -> simplify(flatten(Brep))
curve_curve = CurveCurve(CurveA=flatten(brep_brep.Curves), CurveB=brep_brep_2.Curves)  # -> Points, ParamsA, ParamsB
kerf_of_mdf = Slider(-0.04, range=-10..10)
kerf_of_acrylic = Slider(-0.16, range=-10..10)
unit_z_5 = UnitZ(Factor=height_of_mdf)
division = Division(A=mdf_thickness, B=2)
division_2 = Division(A=acrylic_thickness, B=2)
move_2 = Move(Geometry=curve_curve.Points, Motion=unit_z_5)  # -> Geometry, Transform
addition = Addition(A=division, B=kerf_of_mdf)
addition_2 = Addition(A=division_2, B=kerf_of_acrylic)
center_box = CenterBox(Base=move_2.Geometry, X=expr("(x/2)+1", mdf_thickness), Y=addition_2, Z=expr("x/2", height_of_mdf))  # -> simplify(flatten(Box))
center_box_2 = CenterBox(Base=curve_curve.Points, X=addition, Y=expr("(x/2)+1", acrylic_thickness), Z=expr("x/2", height_of_acrylic))  # -> simplify(flatten(Box))

# ----
# Final Acrylic  Units
trim_solid = TrimSolid(Shape=offset_brep_2, Cutters=center_box_2)
custom_preview = CustomPreview(
    Geometry=trim_solid,
    Material={diffuse=RGB(0, 255, 127), emission=RGB(66, 48, 66), shine=0.5, specular=RGB(255, 255, 255), transparency=0})

# ----
# Final MDF Units
trim_solid_2 = TrimSolid(Shape=offset_brep, Cutters=center_box)
custom_preview_2 = CustomPreview(
    Geometry=trim_solid_2,
    Material={diffuse=RGB(221, 160, 221), emission=RGB(66, 48, 66), shine=0.5, specular=RGB(255, 255, 255), transparency=0})

unit_x = UnitX(Factor=expr("x/2", mdf_thickness))
geometry = Geometry(graft(extrude))
geometry_2 = Geometry(graft(extrude_2))
unit_y = UnitY(Factor=expr("x/2", acrylic_thickness))
move_3 = Move(Geometry=geometry, Motion=unit_x)  # -> Geometry, Transform
geometry_3 = Geometry(flatten(trim_solid_2))
geometry_4 = Geometry(flatten(trim_solid))
move_4 = Move(Geometry=geometry_2, Motion=unit_y)  # -> Geometry, Transform
brep_plane = BrepPlane(Brep=geometry_4, Plane=move_4.Geometry)  # -> flatten(Curves), Points
brep_plane_2 = BrepPlane(Brep=geometry_3, Plane=move_3.Geometry)  # -> flatten(Curves), Points
lng = ListLength(List=brep_plane_2.Curves)
lng_2 = ListLength(List=brep_plane.Curves)
ex = Slider(1, range=0..50)
sx = Slider(1000, range=0..1000)
sy = Slider(242.82, range=0..1000)
ex_2 = Slider(1, range=0..50)
sx_2 = Slider(1000, range=0..1000)
sy_2 = Slider(242.82, range=0..1000)
recgrid = Rectangular(Plane=PlaneXY(0, 1000, 0), SizeX=sx, SizeY=sy, ExtentX=ex, ExtentY=lng)  # -> Cells, Points
recgrid_2 = Rectangular(Plane=PlaneXY(1839, 953, 0), SizeX=sx_2, SizeY=sy_2, ExtentX=ex_2, ExtentY=lng_2)  # -> Cells, Points
polygon_center = PolygonCenter(Polyline=recgrid.Cells)  # -> CenterV, CenterE, CenterA
polygon_center_2 = PolygonCenter(Polyline=recgrid_2.Cells)  # -> CenterV, CenterE, CenterA
xy = XYPlane(Origin=polygon_center.CenterV)
xy_2 = XYPlane(Origin=polygon_center_2.CenterV)
explode = Explode(Curve=recgrid.Cells, Recursive=True)  # -> Segments, Vertices
series_3 = Series(Start=0, Step=1, Count=lng)
explode_2 = Explode(Curve=recgrid_2.Cells, Recursive=True)  # -> Segments, Vertices
series_4 = Series(Start=0, Step=1, Count=lng_2)
list_item_3 = ListItem(List=explode.Vertices, Index=0, Wrap=True)  # -> flatten(Item)
list_item_4 = ListItem(List=explode_2.Vertices, Index=0, Wrap=True)  # -> flatten(Item)
concat = Concatenate(A="MDF", B=series_3)
concat_2 = Concatenate(A="Acrylic", B=series_4)

# ----
# Ready for Fabrication
# (MDF)
orient = Orient(Geometry=brep_plane_2.Curves, Source=yz_plane, Target=xy)  # -> Geometry, Transform
text_tag_3d = TextTag3D(Location=list_item_3, Text=concat, Size=30, Colour=RGB(0, 0, 0), Justification=7)

# ----
# Ready for Fabrication
# (Acrylic)
orient_2 = Orient(Geometry=brep_plane.Curves, Source=xz_plane, Target=xy_2)  # -> Geometry, Transform
text_tag_3d_2 = TextTag3D(Location=list_item_4, Text=concat_2, Size=30, Colour=RGB(0, 0, 0), Justification=7)
