# Grasshopper definition dash line.gh (Grasshopper 1.0.5)

crv = Curve([<curve referenced from the Rhino model> x51])
panel = Panel("""3.5
70""")
panel_2 = Panel("""100
4""")
dispatch = Dispatch(List=crv, DispatchPattern=[True, False])  # -> ListA, ListB
dash = DashPattern(Curve=dispatch.ListB, Pattern=reverse(panel))  # -> Dashes, Gaps
dash_2 = DashPattern(Curve=dispatch.ListA, Pattern=panel_2)  # -> Dashes, Gaps
crv_2 = Curve(dash_2.Dashes)
crv_3 = Curve(dash.Dashes)
