# Grasshopper definition parametric bending.gh (Grasshopper 1.0.5)

anticlockwise = Point([Point(169.5353443, 26.17018286, 0), Point(154.210102, 64.99842289, 0), Point(105.4011369, 29.51855513, 0), Point(62.25864794, 42.91204423, 0), Point(19.86137294, 20.99795084, 0), Point(70.6939704, 89.14533833, 0), Point(16.73366335, 86.50527558, 0)])
max_affection_area = Slider(17, range=0..100)
max_rotation_angle = Slider(270, range=45..270)
clockwise = Point([Point(169.6641278, 84.1871717, 0), Point(141.911273, 13.54939505, 0), Point(116.798481, 77.55481892, 0), Point(68.44025829, 12.77669376, 0), Point(89.49636856, 60.74856577, 0), Point(39.33517621, 65.57794886, 0)])
sqgrid = Square(Plane=PlaneXY(0, 0, 0), Size=1, ExtentX=40, ExtentY=40)  # -> Cells, Points
weave = Weave(Pattern=[0, 1], Stream0=anticlockwise, Stream1=clockwise, NullGaps=False)
pull = PullPoint(Point=sqgrid.Points, Geometry=weave, ClosestOnly=True)  # -> ClosestPoint, Distance
pdecon = Deconstruct(Point=anticlockwise)  # -> XComponent, YComponent, ZComponent
pdecon_2 = Deconstruct(Point=pull.ClosestPoint)  # -> XComponent, YComponent, ZComponent
min = Minimum(A=pull.Distance, B=max_affection_area)
equals = Equality(FirstNumber=pdecon.XComponent, SecondNumber=graft(pdecon_2.XComponent))  # -> Equality, Inequality
equals_2 = Equality(FirstNumber=pdecon.YComponent, SecondNumber=graft(pdecon_2.YComponent))  # -> Equality, Inequality
bnd = Bounds(Numbers=flatten(min))
ma = MassAddition(Input=equals.Equality)  # -> Result, PartialResults
ma_2 = MassAddition(Input=equals_2.Equality)  # -> Result, PartialResults
remap = RemapNumbers(Value=min, Source=bnd, Target=Domain(0, 1))  # -> Mapped, Clipped
and = GateAnd(A=ma.Result, B=ma_2.Result)  # -> flatten(Result)
graph = GraphMapper(remap.Mapped, x0=0, x1=1, y0=0, y1=1, container_name="Gaussian", factor=0.6894012094, mean=0, sdev=0.2851739526)
expression = Expression(x=and, Expression="if(x=True,1,-1)")
lng = ListLength(List=pull.ClosestPoint)  # -> flatten(Length)
bnd_2 = Bounds(Numbers=flatten(graph))
dom = ConstructDomain(DomainStart=0, DomainEnd=max_rotation_angle)
partition = PartitionList(List=expression, Size=lng)
remap_2 = RemapNumbers(Value=graph, Source=bnd_2, Target=dom)  # -> Mapped, Clipped
multiplication = Multiplication(A=remap_2.Mapped, B=partition)
rotate = Rotate(Geometry=sqgrid.Points, Angle=degrees(multiplication), Plane=pull.ClosestPoint)  # -> Geometry, Transform
nurbs = NurbsCurve(Vertices=rotate.Geometry, Degree=3, Periodic=False)  # -> Curve, Length, Domain
preview = CustomPreview(Geometry=nurbs.Curve, Shader=ColourSwatch(SwatchColor=RGB(255, 255, 255)))
