# Grasshopper definition press.gh (Grasshopper 1.0.5)
# plug-ins: Aggregations

pl = Polyline(<polyline referenced from the Rhino model>)
P = Points([Point(2600.501801, -168.1044906, -164.9754744), Point(2605.665571, -156.9554402, -164.9754744), Point(2608.01274, -188.4074982, -164.9754744)])
brep = Brep(<brep referenced from the Rhino model>)
mesh = Mesh(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)
polyline_tile = PolylineTile(Pl=pl, P=P, D=Slider(7, range=0..10), W1=2.3, W2=1)  # -> Tile, A
tile_t_vol = TileTVol(Tile=polyline_tile.Tile, ClosedMeshOrBrep=brep, Num=Slider(130, range=0..200), ClosestPoints=15)  # -> Tile, ID

pl_2 = Polyline(<polyline referenced from the Rhino model>)
P_2 = Points([Point(2118.204564, -228.4783889, -275.8986071), Point(2110.693625, -208.1753813, -275.8986071), Point(2115.857396, -197.0263309, -275.8986071)])
panel = Panel(tile_t_vol.ID)
