# Grasshopper definition Waves.gh (Grasshopper 1.0.5)
# plug-ins: LunchBox

pt = Point([Point(19.36145665, 18.93877257, 0), Point(38.23711739, 18.93877257, 0)])
pt_2 = Point(Point(30.75000339, 14.95946111, 0))
hexagonal = Hexagonal(Plane=PlaneXY(0, 0, 0), Size=1, ExtentX=Slider(42, range=0..100), ExtentY=Slider(23, range=0..100))  # -> Cells, flatten(Points)
construct_domain = ConstructDomain(DomainStart=Slider(0, range=0..3), DomainEnd=Slider(-1.424, range=-3..0))
hexagonal_2 = Hexagonal(Plane=PlaneXY(0, 0, 0), Size=1, ExtentX=Slider(42, range=0..100), ExtentY=Slider(19, range=0..100))  # -> Cells, flatten(Points)
attract = Attractor(AttractorPoints=pt, TargetPoints=hexagonal.Points, AttractorDomain=Domain(0, 1))  # -> Values, Vectors, Distances
attractor_wave = AttractorWave(
    AttractorPoints=pt_2,
    TargetPoints=hexagonal_2.Points,
    AttractorDomain=construct_domain,
    Frequency=Slider(0.295, range=0..1))  # -> Values, Vectors, Distances
multiplication = Multiplication(A=attract.Values, B=Slider(1, range=0..1))
multiplication_2 = Multiplication(A=attractor_wave.Values, B=Slider(0.839, range=0..1))
rectangle = Rectangle(Plane=hexagonal.Points, XSize=multiplication, YSize=multiplication, Radius=0)  # -> Rectangle, Length
rectangle_2 = Rectangle(Plane=hexagonal_2.Points, XSize=multiplication_2, YSize=multiplication_2, Radius=0)  # -> Rectangle, Length
