# Grasshopper definition Circle.gh (Grasshopper 1.0.5)
# plug-ins: Silkworm

number_slider = Slider(225, range=0..500)
number_slider_2 = Slider(0.3, range=0..1)
# Working slider - 0.760
number_slider_3 = Slider(0.579, range=0..1)
multiplication = Multiplication(A=number_slider_2, B=number_slider)
panel = Panel(multiplication)
xy_plane = XYPlane(Origin="35,35,0")
polygon = Polygon(Plane=xy_plane, Radius=Slider(30, range=0..100), Segments=Slider(50, range=0..100), FilletRadius=0)  # -> Polygon, Length
evaluate_curve = EvaluateCurve(Curve=reparameterize(polygon.Polygon), Parameter=0)  # -> Point, Tangent, Angle
pi = Pi(Factor=number_slider_3)
duplicate_data = DuplicateData(Data=pi, Number=number_slider, Order=True)
circle_cnr = CircleCNR(Center=evaluate_curve.Point, Normal=Vector(0, 0, 1), Radius=Slider(0.14, range=0..1))
series = Series(Start=Slider(0, range=0..1), Step=number_slider_2, Count=number_slider)
unit_z = UnitZ(Factor=series)
trim_with_region = TrimWithRegion(Curve=polygon.Polygon, Region=circle_cnr)  # -> Inside, Outside
mass_addition = MassAddition(Input=duplicate_data)  # -> Result, PartialResults
move = Move(Geometry=trim_with_region.Outside, Motion=unit_z)  # -> Geometry, Transform
rotate = Rotate(Geometry=move.Geometry, Angle=mass_addition.PartialResults, Plane=xy_plane)  # -> Geometry, Transform
list_length = ListLength(List=rotate.Geometry)
cull_index = CullIndex(List=rotate.Geometry, Indices=expr("x-1", list_length), Wrap=False)
cull_index_2 = CullIndex(List=rotate.Geometry, Indices=0, Wrap=False)
end_points = EndPoints(Curve=cull_index_2)  # -> Start, End
end_points_2 = EndPoints(Curve=cull_index)  # -> Start, End
line = Line(StartPoint=end_points_2.Start, EndPoint=end_points.End)
join_curves = JoinCurves(Curves=flatten([rotate.Geometry, line]), Preserve=flatten(False))
loadsettings = LoadSettings(String=["absolute_extrudersteps = 1", "acceleration = 0", "bed_size = 200,200", "bed_temperature = 60", "bridge_fan_speed = 100", "bridge_flow_ratio = 1", "bridge_speed = 20", "brim_width = 3", "complete_objects = 0", "cooling = 0"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])
flip_curve = FlipCurve(Curve=join_curves)  # -> Curve, Flag
silkworm_generator = SilkwormGenerator(SettingsDictionary=loadsettings, Geometry=flatten(flip_curve.Curve), Sort=1)  # -> GCode, SilkwormModel
silkworm_viewer = SilkwormViewer(SilkwormModel=silkworm_generator.SilkwormModel, ShowLogistics=True, ShowValues=False, ShowMesh=False, ShowPrinter=False)
replace_text = ReplaceText(Text=silkworm_generator.GCode, Find="M104 S185", Replace="M190 S50", RecursiveReplace=False)
replace_text_2 = ReplaceText(Text=replace_text, Find="M109 S185", Replace="M109 S180", RecursiveReplace=False)
panel_2 = Panel(replace_text_2)
