# Grasshopper definition Floral.gh (Grasshopper 1.0.5)
# plug-ins: Silkworm

polygon = Polygon(Plane=PlaneXY(56, 60, 0), Radius=Slider(50, range=0..100), Segments=Slider(4, range=0..10), FilletRadius=0)  # -> Polygon, Length
fillet = Fillet(Curve=polygon.Polygon, Radius=Slider(1.3, range=0..100))
control_points = ControlPoints(Curve=fillet)  # -> Points, Weights, Knots
area = Area(Geometry=fillet)  # -> Area, Centroid
dispatch = Dispatch(List=control_points.Points, DispatchPattern=[True, False])  # -> ListA, ListB
scale = Scale(Geometry=dispatch.ListA, Center=area.Centroid, Factor=Slider(0.465, range=0.001..3))  # -> Geometry, Transform
point = Point(dispatch.ListB)
point_2 = Point(scale.Geometry)
number_slider = Slider(350, range=0..1000)
number_slider_2 = Slider(0.25, range=0..1)
weave = Weave(Pattern=[0, 1], Stream0=point_2, Stream1=point, NullGaps=False)
kinky_curve = KinkyCurve(Vertices=weave, Degree=3, Angle=0.1745329252)  # -> Curve, Length, Domain
series = Series(Start=0, Step=number_slider_2, Count=number_slider)
interpolate = Interpolate(Vertices=weave, Degree=Slider(7, range=0..9), Periodic=True, KnotStyle=2)  # -> Curve, Length, Domain
unit_z = UnitZ(Factor=series)
graph_mapper = GraphMapper(
    flatten(series),
    x0=0.7,
    x1=100,
    y0=0.7,
    y1=2,
    container_name="Gaussian",
    factor=0.1268911958,
    mean=0.3113346398,
    sdev=0.2094521821)
move = Move(Geometry=interpolate.Curve, Motion=unit_z)  # -> flatten(Geometry), Transform
curve = Curve(graft(move.Geometry))
param_viewer = ParamViewer(curve)
area_2 = Area(Geometry=curve)  # -> Area, Centroid
param_viewer_2 = ParamViewer(area_2.Area)
number = Number(graft(graph_mapper))
scale_2 = Scale(Geometry=curve, Center=area_2.Centroid, Factor=number)  # -> flatten(Geometry), Transform
multiplication = Multiplication(A=number_slider_2, B=number_slider)
curve_self = CurveSelf(Curve=scale_2.Geometry)  # -> Points, Params
pi = Pi(Factor=Slider(0.823, range=0..3))
panel = Panel(multiplication)
shatter = Shatter(Curve=graft(scale_2.Geometry), Parameters=curve_self.Params)  # -> simplify(Segments)
duplicate_data = DuplicateData(Data=pi, Number=number_slider, Order=True)
mass_addition = MassAddition(Input=duplicate_data)  # -> Result, PartialResults
dispatch_2 = Dispatch(List=shatter, DispatchPattern=[True, False])  # -> ListA, ListB
panel_2 = Panel(shatter)
sine = Sine(Value=mass_addition.PartialResults)
square = Square(Value=sine)
curve_2 = Curve(dispatch_2.ListA)
curve_3 = Curve(dispatch_2.ListB)
number_slider_3 = Slider(0, range=0..10)
panel_3 = Panel(dispatch_2.ListA)
join_curves = JoinCurves(Curves=reverse(curve_2), Preserve=True)  # -> flatten(Curves)
absolute = Absolute(Value=square)
evaluate_curve = EvaluateCurve(Curve=reparameterize(join_curves), Parameter=absolute)  # -> Point, Tangent, Angle
circle_cnr = CircleCNR(Center=evaluate_curve.Point, Normal=Vector(0, 0, 1), Radius=Slider(0.1, range=0..1))
trim_with_region = TrimWithRegion(Curve=join_curves, Region=circle_cnr)  # -> Inside, Outside
trim_tree = TrimTree(Tree=trim_with_region.Outside, Depth=2)
curve_4 = Curve(simplify(graft(trim_tree)))
list_length = ListLength(List=flatten(curve_4))
join_curves_2 = JoinCurves(Curves=[curve_4, curve_3], Preserve=False)  # -> simplify(flatten(Curves))
cull_index = CullIndex(List=flatten(curve_4), Indices=expr("x-1", list_length), Wrap=False)
cull_index_2 = CullIndex(List=flatten(curve_4), Indices=0, Wrap=True)
end_points = EndPoints(Curve=cull_index)  # -> Start, End
end_points_2 = EndPoints(Curve=cull_index_2)  # -> Start, End
line = Line(StartPoint=end_points.Start, EndPoint=end_points_2.End)
join_curves_3 = JoinCurves(Curves=flatten([line, join_curves_2]), Preserve=True)
loadsettings = LoadSettings(String=["absolute_extrudersteps = 1", "acceleration = 0", "bed_size = 200,200", "bed_temperature = 60", "bridge_fan_speed = 100", "bridge_flow_ratio = 1", "bridge_speed = 20", "brim_width = 3", "complete_objects = 0", "cooling = 0"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])
silkworm_generator = SilkwormGenerator(SettingsDictionary=loadsettings, Geometry=flatten(join_curves_3), Sort=1)  # -> GCode, SilkwormModel
replace_text = ReplaceText(Text=silkworm_generator.GCode, Find="M104 S185", Replace="M190 S110", RecursiveReplace=False)
silkworm_viewer = SilkwormViewer(
    SilkwormModel=silkworm_generator.SilkwormModel,
    LayerStart=0,
    LayerEnd=Slider(0.935, range=0.001..1),
    ShowLogistics=True,
    ShowValues=False,
    ShowMesh=False,
    ShowPrinter=True)
replace_text_2 = ReplaceText(Text=replace_text, Find="M109 S185", Replace="M109 S230", RecursiveReplace=False)
panel_4 = Panel(replace_text_2)
