# Grasshopper definition Triangle and Ellipse.gh (Grasshopper 1.0.5)
# plug-ins: Silkworm

number_slider = Slider(225, range=0..500)
number_slider_2 = Slider(0.3, range=0..1)
# Working slider - 0.760
number_slider_3 = Slider(0.585, range=0..1)
multiplication = Multiplication(A=number_slider_2, B=number_slider)
panel = Panel(multiplication)
number_slider_4 = Slider(180, range=0..500)
# Working slider - 0.760
number_slider_5 = Slider(0.815, range=0..1)
number_slider_6 = Slider(0.25, range=0..1)
multiplication_2 = Multiplication(A=number_slider_6, B=number_slider_4)

# ----
# Internal web
number_slider_7 = Slider(0.851, range=0..1)

number_slider_8 = Slider(225, range=0..500)

# ----
# Twisting
number_slider_9 = Slider(0.996, range=0.1..5)

xy_plane = XYPlane(Origin="35,35,0")
number_slider_10 = Slider(0, range=0..1)
number_slider_11 = Slider(0.3, range=0..1)
multiplication_3 = Multiplication(A=number_slider_11, B=number_slider_8)
panel_2 = Panel(multiplication_2)
panel_3 = Panel(multiplication_3)
xy_plane_2 = XYPlane(Origin="40,40,0")
polygon = Polygon(Plane=xy_plane, Radius=Slider(30, range=0..100), Segments=Slider(50, range=0..100), FilletRadius=0)  # -> Polygon, Length
xy_plane_3 = XYPlane(Origin="50,50,0")
series = Series(Start=Slider(0, range=0..1), Step=number_slider_6, Count=number_slider_4)
series_2 = Series(Start=number_slider_10, Step=number_slider_11, Count=number_slider_8)
pi = Pi(Factor=number_slider_3)
polygon_2 = Polygon(Plane=xy_plane_2, Radius=Slider(40, range=0..100), Segments=Slider(3, range=0..10), FilletRadius=0)  # -> Polygon, Length
evaluate_curve = EvaluateCurve(Curve=reparameterize(polygon.Polygon), Parameter=0)  # -> Point, Tangent, Angle
unit_z = UnitZ(Factor=series)
ellipse = Ellipse(Plane=xy_plane_3, Radius1=Slider(42, range=0..100), Radius2=Slider(21, range=0..100))  # -> Ellipse, Focus1, Focus2
unit_z_2 = UnitZ(Factor=series_2)
duplicate_data = DuplicateData(Data=pi, Number=number_slider, Order=True)
move = Move(Geometry=polygon_2.Polygon, Motion=unit_z)  # -> Geometry, Transform
circle_cnr = CircleCNR(Center=evaluate_curve.Point, Normal=Vector(0, 0, 1), Radius=Slider(0.14, range=0..1))
pi_2 = Pi(Factor=number_slider_5)
series_3 = Series(Start=Slider(0, range=0..1), Step=number_slider_2, Count=number_slider)
move_2 = Move(Geometry=ellipse.Ellipse, Motion=unit_z_2)  # -> Geometry, Transform
pi_3 = Pi(Factor=number_slider_7)
series_4 = Series(Start=number_slider_10, Step=number_slider_9, Count=number_slider_8)
unit_z_3 = UnitZ(Factor=series_3)
trim_with_region = TrimWithRegion(Curve=polygon.Polygon, Region=circle_cnr)  # -> Inside, Outside
duplicate_data_2 = DuplicateData(Data=pi_2, Number=number_slider_4, Order=True)
area = Area(Geometry=move_2.Geometry)  # -> Area, Centroid
duplicate_data_3 = DuplicateData(Data=pi_3, Number=number_slider_8, Order=True)
mass_addition = MassAddition(Input=duplicate_data)  # -> Result, PartialResults
move_3 = Move(Geometry=trim_with_region.Outside, Motion=unit_z_3)  # -> Geometry, Transform
mass_addition_2 = MassAddition(Input=duplicate_data_2)  # -> Result, PartialResults
mass_addition_3 = MassAddition(Input=duplicate_data_3)  # -> Result, PartialResults
rotate = Rotate(Geometry=move_2.Geometry, Angle=degrees(series_4), Plane=area.Centroid)  # -> Geometry, Transform
cosine = Cosine(Value=mass_addition_2.PartialResults)
rotate_2 = Rotate(Geometry=move_3.Geometry, Angle=mass_addition.PartialResults, Plane=xy_plane)  # -> Geometry, Transform
cosine_2 = Cosine(Value=mass_addition_3.PartialResults)
list_length = ListLength(List=rotate_2.Geometry)
square = Square(Value=cosine)
square_2 = Square(Value=cosine_2)
absolute = Absolute(Value=square)
evaluate_curve_2 = EvaluateCurve(Curve=reparameterize(move.Geometry), Parameter=absolute)  # -> Point, Tangent, Angle
cull_index = CullIndex(List=rotate_2.Geometry, Indices=expr("x-1", list_length), Wrap=False)
cull_index_2 = CullIndex(List=rotate_2.Geometry, Indices=0, Wrap=False)
absolute_2 = Absolute(Value=square_2)
evaluate_curve_3 = EvaluateCurve(Curve=reparameterize(rotate.Geometry), Parameter=absolute_2)  # -> Point, Tangent, Angle
end_points = EndPoints(Curve=cull_index_2)  # -> Start, End
end_points_2 = EndPoints(Curve=cull_index)  # -> Start, End
circle_cnr_2 = CircleCNR(Center=evaluate_curve_2.Point, Normal=Vector(0, 0, 1), Radius=Slider(0.2, range=0..1))
circle_cnr_3 = CircleCNR(Center=evaluate_curve_3.Point, Normal=Vector(0, 0, 1), Radius=Slider(0.2, range=0..1))
line = Line(StartPoint=end_points_2.Start, EndPoint=end_points.End)
trim_with_region_2 = TrimWithRegion(Curve=move.Geometry, Region=circle_cnr_2)  # -> Inside, Outside
join_curves = JoinCurves(Curves=flatten([rotate_2.Geometry, line]), Preserve=flatten(False))
trim_with_region_3 = TrimWithRegion(Curve=rotate.Geometry, Region=circle_cnr_3)  # -> Inside, Outside
trim_tree = TrimTree(Tree=trim_with_region_2.Outside, Depth=1)
param_viewer = ParamViewer(trim_tree)
loadsettings = LoadSettings(String=["absolute_extrudersteps = 1", "acceleration = 0", "bed_size = 200,200", "bed_temperature = 60", "bridge_fan_speed = 100", "bridge_flow_ratio = 1", "bridge_speed = 20", "brim_width = 3", "complete_objects = 0", "cooling = 0"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])
flip_curve = FlipCurve(Curve=join_curves)  # -> Curve, Flag
trim_tree_2 = TrimTree(Tree=trim_with_region_3.Outside, Depth=1)
list_length_2 = ListLength(List=trim_tree)
list_length_3 = ListLength(List=trim_tree_2)
silkworm_generator = SilkwormGenerator(SettingsDictionary=loadsettings, Geometry=flatten(flip_curve.Curve), Sort=1)  # -> GCode, SilkwormModel
cull_index_3 = CullIndex(List=trim_tree, Indices=expr("x-1", list_length_2), Wrap=False)
param_viewer_2 = ParamViewer(trim_tree_2)
cull_index_4 = CullIndex(List=trim_tree, Indices=0, Wrap=False)
cull_index_5 = CullIndex(List=trim_tree_2, Indices=expr("x-1", list_length_3), Wrap=False)
cull_index_6 = CullIndex(List=trim_tree_2, Indices=0, Wrap=False)
silkworm_viewer = SilkwormViewer(SilkwormModel=silkworm_generator.SilkwormModel, ShowLogistics=True, ShowValues=False, ShowMesh=False, ShowPrinter=False)
end_points_3 = EndPoints(Curve=cull_index_3)  # -> Start, End
end_points_4 = EndPoints(Curve=cull_index_4)  # -> Start, End
# External wall speed(feedrate)
curve = Curve(graft(trim_tree_2))
replace_text = ReplaceText(Text=silkworm_generator.GCode, Find="M104 S185", Replace="M190 S50", RecursiveReplace=False)
end_points_5 = EndPoints(Curve=cull_index_5)  # -> Start, End
end_points_6 = EndPoints(Curve=cull_index_6)  # -> Start, End
# Internal web speed(feedrate)
number_slider_12 = Slider(2400, range=0..6000)
line_2 = Line(StartPoint=end_points_3.Start, EndPoint=end_points_4.End)
replace_text_2 = ReplaceText(Text=replace_text, Find="M109 S185", Replace="M109 S180", RecursiveReplace=False)
line_3 = Line(StartPoint=end_points_5.Start, EndPoint=end_points_6.End)
curve_2 = Curve(graft(line_3))
join_curves_2 = JoinCurves(Curves=flatten([line_2, trim_tree]), Preserve=flatten(False))
panel_4 = Panel(replace_text_2)
silkworm_movement = SilkwormMovement(MovementGeometry=curve, SpeedParameter=Slider(900, range=0..10000))
silkworm_movement_2 = SilkwormMovement(MovementGeometry=curve_2, SpeedParameter=number_slider_12)
flip_curve_2 = FlipCurve(Curve=join_curves_2)  # -> Curve, Flag
loadsettings_2 = LoadSettings(String=["absolute_extrudersteps = 1", "acceleration = 0", "bed_size = 200,200", "bed_temperature = 60", "bridge_fan_speed = 100", "bridge_flow_ratio = 1", "bridge_speed = 20", "brim_width = 3", "complete_objects = 0", "cooling = 0"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])
silkworm_generator_2 = SilkwormGenerator(SettingsDictionary=loadsettings_2, Geometry=flatten(flip_curve_2.Curve), Sort=1)  # -> GCode, SilkwormModel
join_curves_3 = JoinCurves(Curves=flatten([line_3, trim_tree_2]), Preserve=flatten(False))
merge = Merge(Data1=silkworm_movement, Data2=silkworm_movement_2)
flip_curve_3 = FlipCurve(Curve=join_curves_3)  # -> Curve, Flag
loadsettings_3 = LoadSettings(String=["absolute_extrudersteps = 1", "acceleration = 0", "bed_size = 200,200", "bed_temperature = 60", "bridge_fan_speed = 100", "bridge_flow_ratio = 1", "bridge_speed = 20", "brim_width = 3", "complete_objects = 0", "cooling = 0"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])
silkworm_viewer_2 = SilkwormViewer(
    SilkwormModel=silkworm_generator_2.SilkwormModel,
    ShowLogistics=True,
    ShowValues=False,
    ShowMesh=False,
    ShowPrinter=False)
replace_text_3 = ReplaceText(Text=silkworm_generator_2.GCode, Find="M104 S185", Replace="M190 S100", RecursiveReplace=False)
silkworm_generator_3 = SilkwormGenerator(SettingsDictionary=loadsettings_3, Geometry=flatten(merge), Sort=1)  # -> GCode, SilkwormModel
silkworm_generator_4 = SilkwormGenerator(SettingsDictionary=loadsettings_3, Geometry=flatten(flip_curve_3.Curve), Sort=1)  # -> GCode, SilkwormModel
replace_text_4 = ReplaceText(Text=replace_text_3, Find="M109 S185", Replace="M109 S230", RecursiveReplace=False)
silkworm_viewer_3 = SilkwormViewer(SilkwormModel=silkworm_generator_3.SilkwormModel, ShowLogistics=True, ShowValues=False, ShowMesh=False, ShowPrinter=True)
replace_text_5 = ReplaceText(Text=silkworm_generator_3.GCode, Find="M104 S185", Replace="M190 S100", RecursiveReplace=False)
replace_text_6 = ReplaceText(Text=silkworm_generator_4.GCode, Find="M104 S185", Replace="M190 S50", RecursiveReplace=False)
replace_text_7 = ReplaceText(Text=replace_text_4, Find="F1200", Replace="F3000", RecursiveReplace=False)
replace_text_8 = ReplaceText(Text=replace_text_5, Find="M109 S185", Replace="M109 S230", RecursiveReplace=False)
replace_text_9 = ReplaceText(Text=replace_text_6, Find="M109 S185", Replace="M109 S180", RecursiveReplace=False)
panel_5 = Panel(replace_text_7)
panel_6 = Panel(replace_text_8)
panel_7 = Panel(replace_text_9)
