# Grasshopper definition GridDist.gh (Grasshopper 0.8.66)

pt = Point(<point referenced from the Rhino model>)
sqgrid = Square(Plane=PlaneXY(0, 0, 0), Size=Slider(1, range=0..3), ExtentX=Slider(68, range=0..100), ExtentY=Slider(73, range=0..100))  # -> Cells, Points
pt_2 = Point(sqgrid.Points)
dist = Distance(PointA=pt_2, PointB=pt)
division = Division(A=dist, B=Slider(7.478, range=0..100))
min = Minimum(A=division, B=1)
pi = Pi(Factor=1)
multiplication = Multiplication(A=min, B=pi)
cos = Cosine(Value=multiplication)
addition = Addition(A=cos, B=1)
multiplication_2 = Multiplication(A=addition, B=Slider(2.21, range=0..10))
min_2 = Minimum(A=multiplication_2, B=Slider(5.21, range=0..10))
vec2pt = Vector2Pt(PointA=pt, PointB=pt_2, Unitize=False)  # -> Vector, Length
amp = Amplitude(Vector=vec2pt.Vector, Amplitude=min_2)
panel = Panel("POINTS")
move = Move(Geometry=pt_2, Motion=amp)  # -> Geometry, Transform
flip = FlipMatrix(Data=move.Geometry)
panel_2 = Panel("LINES")
intcrv = Interpolate(Vertices=flip, Degree=3, Periodic=False)  # -> Curve, Length, Domain
