# Grasshopper definition Surface2WeaveScript.ghx (Grasshopper 0.6.19)

srf = Surface(<surface referenced from the Rhino model>)
threads_num = Slider(20, range=0..42)
weaving_factor = Slider(1.5, range=0..11)
divide = DivideSurface(S=srf, U=threads_num, V=flatten(threads_num))  # -> P, N, uv
vb = DotNETVBScript(InPt=divide.P, inVect=divide.N, u=threads_num, v=threads_num, F=weaving_factor)  # -> out, Upt, UNormal, Vpt, VNormal; inputs InPt: list, inVect: list
# ---------- vb: VB ----------
    'Written and created by Alireza Akhoundi
    'December 2009
    'Alireza.Akhoundi@gmail.com
    'Aakh6363@uni.sydney.edu.au
    
    'declaration of outputs
    Dim uTree As New DataTree (Of On3dPoint)
    Dim uNormalTree As New DataTree (Of On3dvector)
    
    Dim VTree As New DataTree (Of On3dPoint)
    Dim VNormalTree As New DataTree (Of On3dvector)
    
    
    Dim item As New Int32
    'Population of relevant data tree with u strings items
    For j As int32= 0 To v 
      Dim path As New EH_Path(j)
      'Dim counter As Double = 0
      For i As Int32 = 0 To u 
        item = (i * (u + 1)) + j
        Dim pt As New On3dPoint 
        pt = InPt(item)
      
        print(pt.x)
        If j Mod 2 And ( j = 0) = False Then 
          If i Mod 2 Then
            pt = pt - invect(item) * f
          Else
            pt = pt + invect(item) * f
          End If 
        Else 
          If  i Mod 2 Then
            pt = pt + invect(item) * f
          Else
            pt = pt - invect(item) * f
          End If 
        End If 
        
        uTree.Add(pt, path)
        uNormalTree.Add(invect(item), path)
        
      Next
    Next
    
    
    'Population of relevant data tree with v strings items
    For j As int32= 0 To u 
      Dim path As New EH_Path(j)
      'Dim counter As Double = 0
      For i As Int32 = 0 To v 
        item = (j * (u + 1)) + i
        Dim pt As New On3dPoint 
        pt = InPt(item)
        'print(pt.x)
        
        If j Mod 2 And Not j = 0 Then 
          If i Mod 2 Then
            pt = pt + invect(item) * f
          Else
            pt = pt - invect(item) * f
          End If 
        Else 
          If  i Mod 2 Then
            pt = pt - invect(item) * f
          Else
            pt = pt + invect(item) * f
          End If 
        End If 
        
        VTree.Add(pt, path)
        VNormalTree.Add(invect(item), path)
        
      Next
    Next
    
    
    
    Upt = uTree
    UNormal = uNormalTree
    
    Vpt = VTree
    VNormal = VNormalTree
# ---------- end vb ----------
panel = Panel(vb.out)
crv = Curve(V=vb.Vpt, D=3, P=False)  # -> C, L, D
crv_2 = Curve(V=vb.Upt, D=3, P=False)  # -> C, L, D
threads_thickness = Slider(0.25, range=0..2)
pipe = Pipe(C=crv_2.C, R=threads_thickness)
pipe_2 = Pipe(C=crv.C, R=threads_thickness)
cap = CapHoles(B=[pipe_2, pipe])
