# Grasshopper definition lattice structure.gh (Grasshopper 1.0.5)
# plug-ins: Pufferfish, LunchBox, IntraLattice

platonic_octahedron = PlatonicOctahedron(Plane=PlaneXY(0, 0, 0), Radius=1, Truncation=Slider(0.683, range=0..1))
brep_edges = BrepEdges(Brep=platonic_octahedron)  # -> Naked, Interior, NonManifold
list = ValueList({"Grid": 0, "X": 1, "Star": 2, "Cross": 3, "Tesseract": 4, "Vintiles": 5, "Octet": 6, "Diamond": 7, "Honeycomb 1": 8, "Honeycomb 2": 9}, selected="Honeycomb 2")
custom_cell = CustomCell(CustomCell=brep_edges.Interior)
preset_cell = PresetCell(CellTye=list)  # -> Topology, Lines
number_slider = Slider(10, range=0..20)
uniform_ds = UniformDS(
    DesignSpace=<brep referenced from the Rhino model>,
    OrientationPlane=PlaneXY(0, 0, 0),
    CellSizeX=Slider(10, range=0..10),
    CellSizeY=Slider(10, range=0..10),
    CellSizeZ=Slider(10, range=0..10),
    Tolerance=0.2,
    StrictTolerance=False)
number_slider_2 = Slider(10, range=0..10)
basic_box = BasicBox(
    Topology=preset_cell.Topology,
    CellSizeX=number_slider,
    CellSizeY=number_slider,
    CellSizeZ=number_slider,
    NumberOfCellsX=Slider(2, range=0..10),
    NumberOfCellsY=Slider(3, range=0..10),
    NumberOfCellsZ=Slider(3, range=0..10))
conform_surface_surface = ConformSurfaceSurface(NumberU=5, NumberV=5, NumberW=5, Morph=False)
unit_y = UnitY(Factor=number_slider)
extrude = Extrude(Base=basic_box, Direction=unit_y)
offset_surface = OffsetSurface(Surface=extrude, Distance=0.25, BothSides=True, CreateSolid=True)
