# Grasshopper definition meta.gh (Grasshopper 1.0.5)
# plug-ins: LunchBox, Weaverbird

mesh = Mesh(<mesh referenced from the Rhino model>)
mesh_2 = Mesh(<mesh referenced from the Rhino model>)
merge = Merge(Data1=mesh_2, Data2=mesh)
mobius_surface = MobiusSurface(
    UDivisions=100,
    VDivisions=100,
    RParameter=4,
    TParameter=0.5,
    Scale=5,
    Domain1=Domain(-3.141592654, 3.141592654),
    Domain2=Domain(-1, 1))
mjoin = MeshJoin(Meshes=merge)
wbjoin = WeaverbirdsJoinMeshesAndWeld(Mesh=mjoin, Weld=True)

# ---- group: Box Morph
# component
# base surface
mesh_3 = Mesh(wbjoin)
srf = Surface(mobius_surface)
bbox = BoundingBox(Content=mesh_3, Plane=PlaneXY(0, 0, 0))  # -> Box, Box_2
divide = DivideDomain²(Domain=srf, UCount=Slider(20, range=0..20), VCount=Slider(2, range=0..40))
box = BoxComponents(Box=bbox.Box)  # -> Plane, X, Y, Z
sbox = SurfaceBox(Surface=srf, Domain=divide, Height=Slider(3.5, range=0..5))
morph = BoxMorph(Geometry=mesh_3, Reference=bbox.Box, Target=sbox)

# ---- group: Mesh subdivision and thickness
mjoin_2 = MeshJoin(Meshes=morph)
number_slider = Slider(1, range=0..2)
wbjoin_2 = WeaverbirdsJoinMeshesAndWeld(Mesh=mjoin_2, Weld=True)
wbcatmullclark = WeaverbirdsCatmullClarkSubdivision(MeshCurves=wbjoin_2, Level=number_slider, SmoothNakedEdges=2)
wbthicken = WeaverbirdsMeshThicken(MeshCurves=wbcatmullclark, Distance=Slider(1, range=0..1), OffsetType=0)
wbcatmullclark_2 = WeaverbirdsCatmullClarkSubdivision(MeshCurves=wbthicken, Level=number_slider, SmoothNakedEdges=2)
