# Grasshopper definition surfaceWEAVE.ghx (Grasshopper 1.0.5)
# plug-ins: Parakeet

udiv = Slider(20, range=0..100)
vdiv = Slider(8, range=0..50)
height_offsets = Slider(1.5, range=0..5)
point = Point(Point(51.67569967, -50.51449392, 0))
srf = Surface(<surface referenced from the Rhino model>)
sdivide = DivideSurface(Surface=srf, UCount=udiv, VCount=vdiv)  # -> Points, Normals, Parameters
dist = Distance(PointA=point, PointB=sdivide.Points)
vec2pt = Vector2Pt(PointA=point, PointB=sdivide.Points, Unitize=False)  # -> Vector, Length
division = Division(A=dist, B=Slider(0.001, range=0..10))
vector_display = VectorDisplay(Anchor=point, Vector=vec2pt.Vector)
min = Minimum(A=division, B=1)
pi = Pi(Factor=1)
panel = Panel("POINTS")
flatten = FlattenTree(Tree=sdivide.Normals, Path="{0}")
multiplication = Multiplication(A=min, B=pi)
dispatch = Dispatch(List=flatten, DispatchPattern=[True, False])  # -> ListA, ListB
cos = Cosine(Value=multiplication)
f_x = F1(Function="-x", X=height_offsets)
addition = Addition(A=cos, B=Slider(1, range=0..10))
multiplication_2 = Multiplication(A=addition, B=Slider(5, range=0..10))
amp = Amplitude(Vector=dispatch.ListA, Amplitude=height_offsets)
amp_2 = Amplitude(Vector=dispatch.ListA, Amplitude=f_x)
amp_3 = Amplitude(Vector=dispatch.ListB, Amplitude=height_offsets)
amp_4 = Amplitude(Vector=dispatch.ListB, Amplitude=f_x)
min_2 = Minimum(A=multiplication_2, B=Slider(5, range=0..10))
amp_5 = Amplitude(Vector=vec2pt.Vector, Amplitude=min_2)
move = Move(Geometry=sdivide.Points, Motion=amp_5)  # -> Geometry, Transform
flatten_2 = FlattenTree(Tree=move.Geometry, Path="{0}")
weave = Weave(Pattern=[0, 1], Stream0=amp, Stream1=amp_4, NullGaps=False)
weave_2 = Weave(Pattern=[0, 1], Stream0=amp_2, Stream1=amp_3, NullGaps=False)
series = Series(Start=0, Step=expr("x+1", vdiv), Count=expr("x+1", udiv))
series_2 = Series(Start=vdiv, Step=expr("x+1", vdiv), Count=expr("x+1", udiv))
series_3 = Series(Start=0, Step=1, Count=expr("x+1", vdiv))
move_2 = Move(Geometry=flatten_2, Translation=weave_2)
move_3 = Move(Geometry=flatten_2, Translation=weave)
series_4 = Series(Start=series_3, Step=expr("x+1", vdiv), Count=expr("x+1", udiv))
dom = ConstructDomain(DomainStart=series, DomainEnd=series_2)
item = ListItem(List=flatten(move_2), Index=series_4, Wrap=False)
subset = SubList(List=move_3, Domain=dom, Wrap=False)  # -> List, Index
intcrv = Interpolate(Vertices=item, Degree=3, Periodic=False)  # -> Curve, Length, Domain
intcrv_2 = Interpolate(Vertices=subset.List, Degree=3, Periodic=False)  # -> Curve, Length, Domain
number_slider = Slider(2.5, range=0..5.001)
unit_x = UnitX(Factor=number_slider)
unit_y = UnitY(Factor=number_slider)
extrude = Extrude(Base=intcrv_2.Curve, Direction=unit_x)
extrude_2 = Extrude(Base=intcrv.Curve, Direction=unit_y)
offset_brep = OffsetBrep(Brep=extrude, Distance=0.2, Solid=True, BothSides=False, RoundCorners=False, MergeFaces=False)
offset_brep_2 = OffsetBrep(Brep=extrude_2, Distance=0.2, Solid=True, BothSides=False, RoundCorners=False, MergeFaces=False)
unit_x_2 = UnitX(Factor=expr("-x/3", number_slider))
unit_y_2 = UnitY(Factor=expr("-x/2", number_slider))
move_4 = Move(Geometry=offset_brep, Motion=unit_x_2)  # -> Geometry, Transform
move_5 = Move(Geometry=offset_brep_2, Motion=unit_y_2)  # -> Geometry, Transform
